# Dynamo custom node Alert_Popout.dyf (Dynamo 2.10.1.3976)
# category: Revit
# Show alerts from the code
# packages: Data-Shapes 2022.2.103, Clockwork for Dynamo 2.x 2.3.0

code_block = CodeBlock { "Confirm"; }
code_block_2 = CodeBlock { "Alert"; }
Error_Text = Input(Error_Text: var[]..[])
textnote_data = Custom[TextNote Data](Title=code_block_2, TextNote=Error_Text)  # package Data-Shapes; Create Data for TextNote input in UI.MultipleInputForm ++ . Check out www.data-shapes.net for more informations
list_create = List.Create(item0=textnote_data)
Error = Input(Error: bool[])
passthrough = Custom[Passthrough](passThrough=Error, waitFor=list_create)  # package Clockwork for Dynamo 2.x; Forces a sequential order of execution. The node wired into the output of the Passthrough node will be executed *after* the node wired into the waitFor input (e.g. important for some Revit operations). The value of the passThrough input will be passed on to the node wired into the output port of the Passthrough node.
code_block_3 = CodeBlock { "Abort"; }
multipleinputform = Custom[MultipleInputForm ++](ButtonText_optional=code_block, Inputs=list_create, Toggle=passthrough, CancelButtonText_optional=code_block_3)  # package Data-Shapes; Create a form with multiple inputs. see www.data-shapes.net for tutorials and infos!
