# Dynamo custom node CenterSurface.dyf (Dynamo 2.3.0.5885)
# category: 3D-Print.Utilities
# Extracts center surface of a solid

wallSolid = Input(wallSolid: var[]..[])
bySolid = PolySurface.BySolid(solid=wallSolid)
explode = Geometry.Explode(geometry=bySolid)
perimeterCurves = Surface.PerimeterCurves(surface=explode)
length = Curve.Length(curve=perimeterCurves)
wallWidth = Input(wallWidth: var[]..[])
code_block = CodeBlock(x=length, y=wallWidth) { x-y; 0.001; }
gt = code_block.out0 > code_block.out1
allTrue = List.AllTrue(list=gt@L2)
filterByBoolMask = List.FilterByBoolMask(list=explode, mask=allTrue)
doesIntersect = Geometry.DoesIntersect(geometry=filterByBoolMask.in, other=filterByBoolMask.in@L1)
countTrue = List.CountTrue(list=doesIntersect@L2)
maximumItem = List.MaximumItem(list=countTrue)
code_block_2 = CodeBlock(x=maximumItem) { x:int; }
firstIndexOf = List.FirstIndexOf(list=countTrue, item=code_block_2)
getItemAtIndex = List.GetItemAtIndex(list=doesIntersect, index=firstIndexOf)
filterByBoolMask_2 = List.FilterByBoolMask(list=filterByBoolMask.in, mask=getItemAtIndex)
byJoinedSurfaces = PolySurface.ByJoinedSurfaces(surfaces=filterByBoolMask_2.in)
code_block_3 = CodeBlock(x=wallWidth) { -x/2; }
offset = Surface.Offset(surface=byJoinedSurfaces, distance=code_block_3)
centerSurface = Output(offset)
test = Output(byJoinedSurfaces)
