# Dynamo custom node CounterTest.dyf (Dynamo 2.3.0.5885)
# category: 3D-Print.Utilities
# test

dict = Input(dict: var[]..[])
dictToVar = Custom[DictToVar](dict=dict)  # Extracts dictionary content
Limit = Input(Limit: var[]..[])
lt = dictToVar.counter < Limit
test = Output(lt)
