# Dynamo custom node CreateAccess.dyf (Dynamo 2.3.0.5885)
# category: 3D-Print
# Cuts surrounding printing path at access point and returns access geometry

outerPrintingPath = Input(outerPrintingPath: var[]..[])
explode_outer_perimeter_cut = Geometry.Explode(geometry=outerPrintingPath)
accessIdx = Input(accessIdx: var[]..[])
getItemAtIndex = List.GetItemAtIndex(list=explode_outer_perimeter_cut@L2, index=accessIdx)
join = List.Join()  # unwired: list0, list1
nozzleD = Input(nozzleD: var[]..[])
code_block = CodeBlock(nozzleD=nozzleD, c=getItemAtIndex) { off=nozzleD/Curve.Length(c); off2=2*off; }
combine = List.Combine(comb=join, list1=code_block.off, list2=code_block.off2)
splitByParameter = Curve.SplitByParameter(curve=getItemAtIndex, parameters=combine)
accessCurve = Output(splitByParameter)
code_block_2 = CodeBlock(c=splitByParameter) { rC=List.GetItemAtIndex(c@L2<1>,1); Curve.EndPoint(rC); }
accessPoint = Output(code_block_2.out1)
