# Dynamo custom node DictToVar.dyf (Dynamo 2.3.0.5885)
# category: 3D-Print.Utilities
# Extracts dictionary content

dict = Input(dict: var[]..[])
code_block = CodeBlock(dict=dict)
# ---------- code_block.designscript (8 lines) ----------
dict;
per = dict["perimeter"];
path = dict["path"];
idx = dict["accIdx"];
rev = dict["reversed"];
numberOfSolids = dict["nos"];
count = dict["counter"];
nozzleD = dict["nozzleD"];
# ----------------------------------------
perimeter = Output(code_block.per)
path = Output(code_block.path)
accIdx = Output(code_block.idx)
reversed = Output(code_block.rev)
numberOfSolids = Output(code_block.numberOfSolids)
counter = Output(code_block.count)
nozzleD = Output(code_block.nozzleD)
