# Dynamo custom node DrawPrintedGeometry.dyf (Dynamo 2.3.0.5885)
# category: 3D-Print
# Creates a solid from a printing path by swiping a cross section along the path.

printingPath = Input(printingPath: var[]..[])
nozzleD = Input(nozzleD: var[]..[])
layerH = Input(layerH: var[]..[])
code_block = CodeBlock(nozzleD=nozzleD, layerH=layerH) { nozzleD/2+layerH/6; }
code_block_2 = CodeBlock { false; true; }
fillet = PolyCurve.Fillet(polyCurve=printingPath, radius=code_block, rightSide=code_block_2.out0)
fillet_2 = PolyCurve.Fillet(polyCurve=fillet, radius=code_block, rightSide=code_block_2.out1)
endPoint = Curve.EndPoint(curve=fillet_2)
normalAtParameter = Curve.NormalAtParameter(curve=fillet_2)
regularCrossSection = Custom[RegularCrossSection](centerPoint=endPoint, normal=normalAtParameter, nozzleSize=nozzleD, layerThickness=layerH)  # Creates a cross section of a 3D printing layer
sweepAsSolid = Curve.SweepAsSolid(curve=regularCrossSection, path=fillet_2)

# group: path finish -> inter layer connections
startPoint = Curve.StartPoint(curve=fillet_2)
normalAtParameter_2 = Curve.NormalAtParameter(curve=fillet_2)
regularCrossSection_2 = Custom[RegularCrossSection](centerPoint=startPoint, normal=normalAtParameter_2, nozzleSize=nozzleD, layerThickness=layerH)
code_block_3 = CodeBlock(sP=startPoint) { List.Count(sP)-1; }
takeItems = List.TakeItems(list=startPoint, amount=code_block_3)
endPoint_2 = Curve.EndPoint(curve=fillet_2)
restOfItems = List.RestOfItems(list=endPoint_2)
byStartPointEndPoint = Line.ByStartPointEndPoint(startPoint=takeItems, endPoint=restOfItems)

sweepAsSolid_2 = Curve.SweepAsSolid(curve=regularCrossSection_2, path=byStartPointEndPoint)
join = List.Join(list0=sweepAsSolid, list1=sweepAsSolid_2)
byUnion = Solid.ByUnion(solids=join)
printedSolid = Output(byUnion)
