# Dynamo custom node InnerPerimeterPath.dyf (Dynamo 2.3.0.5885)
# category: 3D-Print
# Creates inner path along the perimeter path

# group: Inputs
nozzleD = Input(nozzleD: var[]..[])
outerPath = Input(outerPath: var[]..[])
accessIndex = Input(accessIndex: var[]..[])
outerPerimeter = Input(outerPerimeter: var[]..[])
reversed = Input(reversed: var[]..[])
numberOfSolids = Input(numberOfSolids: var[]..[])

createAccess = Custom[CreateAccess](nozzleD=nozzleD, outerPrintingPath=outerPath, accessIdx=accessIndex)  # Cuts surrounding printing path at access point and returns access geometry
start_curve = CodeBlock(perimeter=outerPerimeter, reverse=reversed, nos=numberOfSolids, nozzleD=nozzleD)
# ---------- start_curve.designscript (36 lines) ----------
// Explode perimeter and reverse if outer perimeter is not reversed
exPer=Geometry.Explode(perimeter);
reverse;
nos;
expl=[Imperative]{
if (!reverse)
{
return exPer;
}
else
{
reverted=[];
for (i in 0..List.Count(exPer)-1)
{
reverted[i]=List.Reverse(exPer[i]);
reverted[i]=List.ShiftIndices(reverted[i],-nos+2);
}
return reverted;
}
};
// Create first curve
cRest=List.RemoveItemAtIndex(expl@L2<1>,1);
cJoined=PolyCurve.ByJoinedCurves(cRest,0.0001);
offCurve=Curve.Offset(cJoined,-nozzleD);
exOffCurve=Curve.Explode(offCurve);
firstExCurve=List.FirstItem(exOffCurve@L2<1>);
firstCurve=[Imperative]{
if(reverse)
{
return firstExCurve;
}
else
{
return PolyCurve.Reverse(firstExCurve);
}
};
# ----------------------------------------
create_perimeter_offset_and = CodeBlock(perimeter=outerPerimeter, nozzleD=nozzleD, reversed=reversed, nos=numberOfSolids, idxPrev=accessIndex)  # "Create perimeter offset and reverse it if necessary"
# ---------- create_perimeter_offset_and.designscript (31 lines) ----------
offPer = Curve.Offset(perimeter,-nozzleD);
exPer = Geometry.Explode(offPer);
!reversed;
nos;
idxPrev+nos+1;
innerPer = [Imperative]{
if (!reversed)
{
reverted=[];
for (i in 0..List.Count(exPer)-1)
{
reverted[i]=List.Reverse(exPer[i]);
}
return PolyCurve.Reverse(reverted);
}
else
{
return exPer;
}
};
shiftIdx = [Imperative]{
if (!reversed)
{
return 1;
}
else
{
return nos-1;
}
};
List.ShiftIndices(innerPer@L2<1>,shiftIdx);
# ----------------------------------------
create_last_curve_and_replace_in = CodeBlock(innerPer=create_perimeter_offset_and.out7, nozzleD=nozzleD, accPt=createAccess.accessPoint)  # "Create last curve and replace in perimeter list"
# ---------- create_last_curve_and_replace_in.designscript (8 lines) ----------
lastCurve = List.LastItem(innerPer@L2<1>);
off=1-nozzleD/Curve.Length(lastCurve);
trimLastCurve = Curve.TrimByEndParameter(lastCurve,off);
endConnect = Line.ByStartPointEndPoint(Curve.EndPoint(trimLastCurve),accPt);
joinedEnd = Curve.Join(trimLastCurve@L1<1>,endConnect@L1<1>);
idx=List.Count(List.FirstItem(innerPer))-1;
lastReplaced = List.ReplaceItemAtIndex(innerPer@L2<1>,idx,joinedEnd@L1<1>);
List.RestOfItems(lastReplaced@L2<1>);
# ----------------------------------------
join = Curve.Join(curve=start_curve.out9, curves=create_last_curve_and_replace_in.out7)
connect_inner_to_outer_path = CodeBlock(accCurve=createAccess.accessCurve, innerPer=join, outerPath=outerPath, accIdx=accessIndex)
# ---------- connect_inner_to_outer_path.designscript (5 lines) ----------
innerPerAcc = List.ReplaceItemAtIndex(accCurve@L2<1>,1,innerPer@L1<1>);
innerPoly = PolyCurve.ByJoinedCurves(innerPerAcc@L2<1>,0.01);
outerPathEx = Geometry.Explode(outerPath);
totalPath = List.ReplaceItemAtIndex(outerPathEx@L2<1>,accIdx,innerPoly@L1<1>);
Curve.Join(List.FirstItem(totalPath@L2<1>),List.RestOfItems(totalPath@L2<1>));
# ----------------------------------------

# group: Output
innerPerimeterPath = Output(connect_inner_to_outer_path.out4)
accessIdx = Output(create_perimeter_offset_and.out4)
reversed_2 = Output(create_perimeter_offset_and.out2)  # "reversed"
perimeter = Output(create_perimeter_offset_and.out0)
