# Dynamo custom node InnerRibs.dyf (Dynamo 2.6.1.8786)
# category: 3D-Print

code_block = CodeBlock { null; 0; }
dict = Input(dict: var[]..[])
dictToVar = Custom[DictToVar](dict=dict)  # Extracts dictionary content
divisions = Input(divisions: var[]..[])

# group: inner Zick Zack
createAccess = Custom[CreateAccess](nozzleD=dictToVar.nozzleD, outerPrintingPath=dictToVar.path, accessIdx=dictToVar.accIdx)  # Cuts surrounding printing path at access point and returns access geometry
create_perimeter_offset_and = CodeBlock(perimeter=dictToVar.perimeter, nozzleD=dictToVar.nozzleD, reversed=dictToVar.reversed, nos=dictToVar.numberOfSolids)  # "Create perimeter offset and reverse it if necessary"
# ---------- create_perimeter_offset_and.designscript (34 lines) ----------
offPer = Autodesk.DesignScript.Geometry.Curve.Offset(perimeter,-nozzleD);
exPer = Geometry.Explode(offPer);
!reversed;
nos;
outerPer = [Imperative]{
if (!reversed)
{
reverted=[];
for (i in 0..List.Count(exPer)-1)
{
reverted[i]=List.Reverse(exPer[i]);
}
return PolyCurve.Reverse(reverted);
}
else
{
return exPer;
}
};
shiftIdx = [Imperative]{
if (!reversed)
{
return 1;
}
else
{
return nos-1;
}
};
outer = List.ShiftIndices(outerPer@L2<1>,shiftIdx);
outerPoly = PolyCurve.ByJoinedCurves(outer,0.0001);
offOuter = Autodesk.DesignScript.Geometry.Curve.Offset(outerPoly,-nozzleD);
inner = Geometry.Explode(offOuter);
middleCurve = List.GetItemAtIndex(outer@L2<1>,nos);
# ----------------------------------------
removeSides = Custom[RemoveSides](geometry=create_perimeter_offset_and.out6, numberOfSolids=dictToVar.numberOfSolids)  # Removes the sides of a perimeter curve by bool mask.
code_block_2 = CodeBlock(c=removeSides.outerBorder, nozzleD=dictToVar.nozzleD)
# ---------- code_block_2.designscript (4 lines) ----------
curves = PolyCurve.Curves(c);
len = Autodesk.DesignScript.Geometry.Curve.Length(curves);
off1 = nozzleD/len;
off2 = 1-off1;
# ----------------------------------------
trimByParameter = Curve.TrimByParameter(curve=code_block_2.curves@L2, startParameter=code_block_2.off1@L2, endParameter=code_block_2.off2@L2)
transpose = List.Transpose(lists=trimByParameter)
pointsAtEqualSegmentLength = Curve.PointsAtEqualSegmentLength(curve=transpose, divisions=divisions)
removeSides_2 = Custom[RemoveSides](geometry=create_perimeter_offset_and.out9, numberOfSolids=dictToVar.numberOfSolids)
code_block_3 = CodeBlock(c=removeSides_2.innerBorder, nozzleD=dictToVar.nozzleD)  # same code as code_block_2
trimByParameter_2 = Curve.TrimByParameter(curve=code_block_3.curves@L2, startParameter=code_block_3.off1@L2, endParameter=code_block_3.off2@L2)
transpose_2 = List.Transpose(lists=trimByParameter_2)
closestPointTo = Geometry.ClosestPointTo(geometry=transpose_2, other=pointsAtEqualSegmentLength)
byStartPointEndPoint = Line.ByStartPointEndPoint(startPoint=pointsAtEqualSegmentLength, endPoint=closestPointTo)
code_block_4 = CodeBlock { 2; 1; }
takeEveryNthItem = List.TakeEveryNthItem(list=byStartPointEndPoint@L2, n=code_block_4.out0, offset=code_block_4.out1)
takeEveryNthItem_2 = List.TakeEveryNthItem(list=byStartPointEndPoint@L2, n=code_block_4.out0)
count = List.Count(list=pointsAtEqualSegmentLength@L2)
code_block_5 = CodeBlock(x=count) { x-1; }
takeItems = List.TakeItems(list=pointsAtEqualSegmentLength@L2, amount=code_block_5@L1)
restOfItems = List.RestOfItems(list=pointsAtEqualSegmentLength@L2)
distanceTo = Geometry.DistanceTo(geometry=takeItems@L2, other=restOfItems@L2)
code_block_6 = CodeBlock(dist=distanceTo, nozzleD=dictToVar.nozzleD, c=takeEveryNthItem_2)
# ---------- code_block_6.designscript (8 lines) ----------
fdist = List.Flatten(dist);
r = Math.Round(List.FirstItem(fdist),4) - nozzleD/2;
l = Curve.Length(c);
par = r/l;
vec1 = Line.Direction(c);
vec2 = Vector.YAxis();
angle1 = Vector.AngleWithVector(vec1,vec2) - 180;
angle2 = angle1 + 180;
# ----------------------------------------
trimByStartParameter = Curve.TrimByStartParameter(curve=takeEveryNthItem_2, startParameter=code_block_6.par)
startPoint = Curve.StartPoint(curve=trimByStartParameter)
byCenterPointRadiusAngle = Arc.ByCenterPointRadiusAngle(center=startPoint, radius=code_block_6.r, startAngle=code_block_6.angle1, endAngle=code_block_6.angle2)
code_block_7 = CodeBlock { true; false; }
startCurve = Custom[StartCurve](perimeter=dictToVar.perimeter, reverse=dictToVar.reversed, numberOfSolids=dictToVar.numberOfSolids, nozzleD=dictToVar.nozzleD)  # Creates a offset curve that connects to the outer perimeter
startPoint_2 = Curve.StartPoint(curve=trimByParameter@L1)
parameterAtPoint = Curve.ParameterAtPoint(curve=startCurve, point=startPoint_2)
trimByEndParameter = Curve.TrimByEndParameter(curve=startCurve, endParameter=parameterAtPoint)
endPoint = Curve.EndPoint(curve=transpose@L2)
startPoint_3 = Curve.StartPoint(curve=create_perimeter_offset_and.out10@L2)
byStartPointEndPoint_2 = Line.ByStartPointEndPoint(startPoint=endPoint@L1, endPoint=startPoint_3@L1)
code_block_8 = CodeBlock(geo=create_perimeter_offset_and.out6, nozzleD=dictToVar.nozzleD)
# ---------- code_block_8.designscript (3 lines) ----------
c=List.LastItem(geo@L2<1>);
startPar=1-nozzleD/Autodesk.DesignScript.Geometry.Curve.Length(c);
Autodesk.DesignScript.Geometry.Curve.TrimByEndParameter(c,startPar);
# ----------------------------------------
endPoint_2 = Curve.EndPoint(curve=code_block_8.out2)
byStartPointEndPoint_3 = Line.ByStartPointEndPoint(startPoint=endPoint_2, endPoint=createAccess.accessPoint)

count_2 = List.Count(list=closestPointTo@L2)
code_block_9 = CodeBlock(x=count_2) { x-1; }
takeItems_2 = List.TakeItems(list=closestPointTo@L2, amount=code_block_9@L1)
restOfItems_2 = List.RestOfItems(list=closestPointTo@L2)
distanceTo_2 = Geometry.DistanceTo(geometry=takeItems_2@L2, other=restOfItems_2@L2)

# group (continued): inner Zick Zack
code_block_10 = CodeBlock(dist=distanceTo_2, nozzleD=dictToVar.nozzleD, c=takeEveryNthItem)
# ---------- code_block_10.designscript (8 lines) ----------
fdist = List.Flatten(dist);
r = Math.Round(List.FirstItem(fdist),4) - nozzleD/2;
l = Curve.Length(c);
par = (l-r)/l;
vec1 = Line.Direction(c);
vec2 = Vector.YAxis();
angle1 = Vector.AngleWithVector(vec1,vec2) - 180;
angle2 = angle1 + 180;
# ----------------------------------------
trimByEndParameter_2 = Curve.TrimByEndParameter(curve=takeEveryNthItem, endParameter=code_block_10.par)
endPoint_3 = Curve.EndPoint(curve=trimByEndParameter_2)
byCenterPointRadiusAngle_2 = Arc.ByCenterPointRadiusAngle(center=endPoint_3, radius=code_block_10.r, startAngle=code_block_10.angle2, endAngle=code_block_10.angle1)
firstItem = List.FirstItem(list=byCenterPointRadiusAngle_2@L2)
restOfItems_3 = List.RestOfItems(list=byCenterPointRadiusAngle_2@L2)
byBlendBetweenCurves = Curve.ByBlendBetweenCurves(curve1=byCenterPointRadiusAngle, curve2=restOfItems_3, endOrStart1=code_block_7.out1)
byBlendBetweenCurves_2 = Curve.ByBlendBetweenCurves(curve1=byCenterPointRadiusAngle_2, curve2=byCenterPointRadiusAngle, endOrStart2=code_block_7.out0)
join = Curve.Join(curve=byBlendBetweenCurves_2@@L1, curves=byCenterPointRadiusAngle@L1)
join_2 = Curve.Join(curve=byBlendBetweenCurves@@L1, curves=join@L1)
join_3 = Curve.Join(curve=restOfItems_3@@L1, curves=join_2@L1)
join_4 = Curve.Join(curve=firstItem@L1, curves=join_3@L2)
byBlendBetweenCurves_3 = Curve.ByBlendBetweenCurves(curve1=firstItem, curve2=trimByEndParameter, endOrStart1=code_block_7.out1, endOrStart2=code_block_7.out0)
join_5 = Curve.Join(curve=join_4@L1, curves=byBlendBetweenCurves_3@L1)
lastItem = List.LastItem(list=byCenterPointRadiusAngle_2@L2)
byBlendBetweenCurves_4 = Curve.ByBlendBetweenCurves(curve1=lastItem@L1, curve2=byStartPointEndPoint_2@L1)
join_6 = Curve.Join(curve=join_5@L1, curves=byBlendBetweenCurves_4@L1)
code_block_11 = CodeBlock(zickZack=join_6, middleCurve=create_perimeter_offset_and.out10, zToMid=byStartPointEndPoint_2, firstPart=trimByEndParameter, sideBack=removeSides.innerBorder, last=code_block_8.out2, connect=byStartPointEndPoint_3)
# ---------- code_block_11.designscript (5 lines) ----------
p1 = Autodesk.DesignScript.Geometry.Curve.EndPoint(zickZack);
p2 = Autodesk.DesignScript.Geometry.Curve.StartPoint(middleCurve);
zToMid;
l = [firstPart,zickZack,zToMid,middleCurve,sideBack,last,connect];
PolyCurve.ByJoinedCurves(List.Transpose(l),0.01);
# ----------------------------------------
connect_inner_to_outer_path = CodeBlock(accCurve=createAccess.accessCurve, innerPer=code_block_11.out4, outerPath=dictToVar.path, accIdx=dictToVar.accIdx)
# ---------- connect_inner_to_outer_path.designscript (5 lines) ----------
innerPerAcc = List.ReplaceItemAtIndex(accCurve@L2<1>,1,innerPer@L1<1>);
innerPoly = PolyCurve.ByJoinedCurves(innerPerAcc@L2<1>,0.01);
outerPathEx = Geometry.Explode(outerPath);
totalPath = List.ReplaceItemAtIndex(outerPathEx@L2<1>,accIdx,innerPoly@L1<1>);
Autodesk.DesignScript.Geometry.Curve.Join(List.FirstItem(totalPath@L2<1>),List.RestOfItems(totalPath@L2<1>));
# ----------------------------------------

varToDict = Custom[VarToDict](perimeter=code_block.out0, path=connect_inner_to_outer_path.out4, accIdx=code_block.out1, reversed=create_perimeter_offset_and.out2, numberOfSolids=dictToVar.numberOfSolids, counter=code_block.out1, nozzleD=dictToVar.nozzleD)  # Creates dictionary from Variables
dict_2 = Output(varToDict)  # "dict"
