# Dynamo custom node InnerZickZack.dyf (Dynamo 2.10.1.3976)
# category: 3D-Print
# Creates an inner zick zack path from a perimeter path.

dict = Input(dict: var[]..[])
dictToVar = Custom[DictToVar](dict=dict)  # Extracts dictionary content

# group: inner Zick Zack
create_perimeter_offset_and = CodeBlock(perimeter=dictToVar.perimeter, nozzleD=dictToVar.nozzleD, reversed=dictToVar.reversed, nos=dictToVar.numberOfSolids)  # "Create perimeter offset and reverse it if necessary"
# ---------- create_perimeter_offset_and.designscript (34 lines) ----------
offPer = Autodesk.DesignScript.Geometry.Curve.Offset(perimeter,-nozzleD);
exPer = Geometry.Explode(offPer);
!reversed;
nos;
outerPer = [Imperative]{
if (!reversed)
{
reverted=[];
for (i in 0..List.Count(exPer)-1)
{
reverted[i]=List.Reverse(exPer[i]);
}
return PolyCurve.Reverse(reverted);
}
else
{
return exPer;
}
};
shiftIdx = [Imperative]{
if (!reversed)
{
return 1;
}
else
{
return nos-1;
}
};
outer = List.ShiftIndices(outerPer@L2<1>,shiftIdx);
outerPoly = PolyCurve.ByJoinedCurves(outer,0.0001);
offOuter = Autodesk.DesignScript.Geometry.Curve.Offset(outerPoly,-nozzleD);
inner = Geometry.Explode(offOuter);
middleCurve = List.GetItemAtIndex(outer@L2<1>,nos);
# ----------------------------------------
removesides_outer_perimeter = Custom[RemoveSides Outer Perimeter](geometry=create_perimeter_offset_and.out6, numberOfSolids=dictToVar.numberOfSolids)  # Removes the sides of a perimeter curve by bool mask.
code_block = CodeBlock(c=removesides_outer_perimeter.outerBorder, nozzleD=dictToVar.nozzleD)
# ---------- code_block.designscript (4 lines) ----------
curves = PolyCurve.Curves(c);
len = Autodesk.DesignScript.Geometry.Curve.Length(curves);
off1 = nozzleD/len;
off2 = 1-off1;
# ----------------------------------------
trimByParameter = Curve.TrimByParameter(curve=code_block.curves@L2, startParameter=code_block.off1@L2, endParameter=code_block.off2@L2)
transpose = List.Transpose(lists=trimByParameter)
createAccess = Custom[CreateAccess](nozzleD=dictToVar.nozzleD, outerPrintingPath=dictToVar.path, accessIdx=dictToVar.accIdx)  # Cuts surrounding printing path at access point and returns access geometry
removesides_offset_perimeter = Custom[RemoveSides Offset Perimeter](geometry=create_perimeter_offset_and.out9, numberOfSolids=dictToVar.numberOfSolids)  # Removes the sides of a perimeter curve by bool mask.
code_block_2 = CodeBlock(c=removesides_offset_perimeter.innerBorder, nozzleD=dictToVar.nozzleD)  # same code as code_block
trimByParameter_2 = Curve.TrimByParameter(curve=code_block_2.curves@L2, startParameter=code_block_2.off1@L2, endParameter=code_block_2.off2@L2)
transpose_2 = List.Transpose(lists=trimByParameter_2)
code_block_3 = CodeBlock { 2; 1; }
startPoint = Curve.StartPoint(curve=trimByParameter@L2)
transpose_3 = List.Transpose(lists=startPoint)
endPoint = Curve.EndPoint(curve=trimByParameter@L2)
transpose_4 = List.Transpose(lists=endPoint)
startCurve = Custom[StartCurve](perimeter=dictToVar.perimeter, reverse=dictToVar.reversed, numberOfSolids=dictToVar.numberOfSolids, nozzleD=dictToVar.nozzleD)  # Creates a offset curve that connects to the outer perimeter
code_block_4 = CodeBlock(geo=create_perimeter_offset_and.out6, nozzleD=dictToVar.nozzleD)
# ---------- code_block_4.designscript (3 lines) ----------
c=List.LastItem(geo@L2<1>);
startPar=1-nozzleD/Autodesk.DesignScript.Geometry.Curve.Length(c);
Autodesk.DesignScript.Geometry.Curve.TrimByEndParameter(c,startPar);
# ----------------------------------------
endPoint_2 = Curve.EndPoint(curve=code_block_4.out2)
byStartPointEndPoint = Line.ByStartPointEndPoint(startPoint=endPoint_2, endPoint=createAccess.accessPoint)

wall_thickness = Input(wall_thickness: var[]..[])
angle = Input(angle: var[]..[])

# group: Tan zigzag angle and step functionality
watch = Watch(transpose)
length = Curve.Length(curve=watch)
compensate_zigzag_location_in = CodeBlock(x=wall_thickness, y=dictToVar.nozzleD) { x-(3*y); }  # "Compensate zigzag location in center"
tan = Math.Tan(angle=angle)
watch_2 = Watch(tan)
division_distance_between_two = compensate_zigzag_location_in / watch_2  # "Division - Distance between two points"
division_number_of_splits_for = length / division_distance_between_two  # "Division - number of splits for each curve"
round_to_the_nearest_even_number = CodeBlock(a=division_number_of_splits_for) { Math.Round(a/2)*2; }
watch_3 = Watch(round_to_the_nearest_even_number)
pointsAtEqualSegmentLength = Curve.PointsAtEqualSegmentLength(curve=transpose, divisions=watch_3)
watch_4 = Watch(pointsAtEqualSegmentLength)
list_flatten_possible_to_use = List.Flatten(list=watch_3)  # "List.Flatten Possible to use both 1st and second implementation"
code_block_5 = CodeBlock(PointsInput=list_flatten_possible_to_use)
# ---------- code_block_5.designscript (15 lines) ----------
PointsInput;
LastValue = PointsInput[0];
PointsUnique = [Imperative]{
unique = [];
unique = List.AddItemToEnd(PointsInput[0], unique);
for (i in 0..(List.Count(PointsInput)-1))
{
	if(PointsInput[i] != LastValue)
	{
		unique = List.AddItemToEnd(PointsInput[i], unique);
		LastValue = PointsInput[i];
	}
}
return unique;
};
# ----------------------------------------
watch_5 = Watch(code_block_5.out2)
transpose_5 = List.Transpose(lists=code_block_5.out2)
watch_6 = Watch(code_block_5.out1)
code_block_6 = CodeBlock { 0; }
list_getitematindex_seems_to_be = List.GetItemAtIndex(list=watch_3@L2, index=code_block_6)  # "List.GetItemAtIndex - Seems to be more efficient"

code_block_7 = CodeBlock { null; 0; }
code_block_8 = CodeBlock(x=create_perimeter_offset_and.out9) { x; y=x[0]; }
code_block_9 = CodeBlock(y=code_block_8.y, NumberOfSolids=dictToVar.numberOfSolids) { y[0..(NumberOfSolids-1)]; }
direction = Line.Direction(line=code_block_9)

# group: Distance between points in each solid
code_block_10 = CodeBlock { 2; }
takeItems = List.TakeItems(list=pointsAtEqualSegmentLength@L2, amount=code_block_10)
transpose_6 = List.Transpose(lists=takeItems)
code_block_11 = CodeBlock(x=transpose_6) { x[0]; x[1]; }
distanceTo = Geometry.DistanceTo(geometry=code_block_11.out0, other=code_block_11.out1)

Displacement = Input(Displacement: var[]..[])

# group: Zigzag displacement
code_block_12 = CodeBlock { 1; }
flatten = List.Flatten(list=pointsAtEqualSegmentLength, amt=code_block_12)
code_block_13 = CodeBlock(direction=direction, distance=distanceTo, numberOfSolids=dictToVar.numberOfSolids, displacement=Displacement, original=flatten)
# ---------- code_block_13.designscript (38 lines) ----------
direction;
distance;
numberOfSolids;
displacement;
original;

geometry = original;
pointsCount = List.Count(original@L2<1>);

translatedPoints = [Imperative]{

points = [];
if (displacement == 0)
{
	return original;
}
else
{

	for (i in 0..numberOfSolids-1)
	{
		// Keep first two points untouched
		points[i][0] = geometry[i][0];
		points[i][1] = geometry[i][1];
		// Keep last two points untouched
		points[i][pointsCount[i]-2] = geometry[i][pointsCount[i]-2];
		points[i][pointsCount[i]-1] = geometry[i][pointsCount[i]-1];
		// Move all other points
		for (j in 2..pointsCount[i]-3)	// number of remaining points in each solid
		{
			points[i][j] = Geometry.Translate(geometry[i][j],direction[i],distance[i]*displacement);
			//points[i] = Geometry.Translate(geometry[2..(pointsCount[i]-3)],direction[i],distance[i]*displacement);
		}

	}
	return points;
}
};
# ----------------------------------------
code_block_14 = CodeBlock(pointsInput=code_block_13.out7, numberOfSolids=dictToVar.numberOfSolids)
# ---------- code_block_14.designscript (10 lines) ----------
pointsInput;
numberOfSolids;
PointsRestructure = [Imperative]{
restructure = [];
for (i in 0..numberOfSolids-1)
{
	restructure=List.AddItemToEnd([pointsInput[i]],restructure);
}
return restructure;
};
# ----------------------------------------

# group (continued): inner Zick Zack
closestPointTo = Geometry.ClosestPointTo(geometry=transpose_2, other=code_block_14.out2)
transpose_7 = List.Transpose(lists=closestPointTo@L3)
dropEveryNthItem = List.DropEveryNthItem(list=transpose_7@L3, n=code_block_3.out0)
transpose_8 = List.Transpose(lists=code_block_14.out2@L3)
dropEveryNthItem_2 = List.DropEveryNthItem(list=transpose_8@L3, n=code_block_3.out0, offset=code_block_3.out1)
byStartPointEndPoint_2 = Line.ByStartPointEndPoint(startPoint=dropEveryNthItem, endPoint=dropEveryNthItem_2)
restOfItems = List.RestOfItems(list=dropEveryNthItem@L3)
byStartPointEndPoint_3 = Line.ByStartPointEndPoint(startPoint=dropEveryNthItem_2, endPoint=restOfItems)
firstItem = List.FirstItem(list=dropEveryNthItem@L3)
byStartPointEndPoint_4 = Line.ByStartPointEndPoint(startPoint=transpose_3, endPoint=firstItem)
lastItem = List.LastItem(list=dropEveryNthItem@L3)
byStartPointEndPoint_5 = Line.ByStartPointEndPoint(startPoint=lastItem, endPoint=transpose_4)
merge_zick_zack_lines_per = CodeBlock(linesDown=byStartPointEndPoint_2, linesUp=byStartPointEndPoint_3, numberOfSolids=dictToVar.numberOfSolids, numberOfLines=list_getitematindex_seems_to_be, linesStart=byStartPointEndPoint_4, linesEnd=byStartPointEndPoint_5)  # "Merge zick zack lines per element"
# ---------- merge_zick_zack_lines_per.designscript (22 lines) ----------
linesDown;
linesUp;
numberOfSolids;
numberOfLines;
linesStart;
linesEnd;
linesTotal = [Imperative]{
lines = [];
for (i in 0..numberOfSolids-1)
{
	l = [];
	l[0]=linesStart[i];
	for (j in 0..(numberOfLines[i]/2-2))
	{
		l[2*j+1] = linesDown[i][j];
		l[2*j+2] = linesUp[i][j];
	}
	l[numberOfLines[i]-1] = linesEnd[i];
	lines = List.AddItemToEnd(l,lines);
}
return lines;
};
# ----------------------------------------
merge_elements = CodeBlock(refLineOuter=transpose, refLineInner=transpose_2, zickZack=merge_zick_zack_lines_per.out6, numberOfSolids=dictToVar.numberOfSolids)
# ---------- merge_elements.designscript (45 lines) ----------
refLineOuter;
refLineInner;
zickZack;
numberOfSolids;
z = Vector.ZAxis();
outerEndPoints = Autodesk.DesignScript.Geometry.Curve.EndPoint(refLineOuter);
outerStartPoints = Autodesk.DesignScript.Geometry.Curve.StartPoint(refLineOuter);
innerEndPoints = Autodesk.DesignScript.Geometry.Curve.EndPoint(refLineInner);
innerStartPoints = Autodesk.DesignScript.Geometry.Curve.StartPoint(refLineInner);

totalZickZack = [Imperative]{
if (numberOfSolids == 1)
{
	return zickZack;
}
else {
	newZickZack=[];
	newZickZack = List.AddItemToEnd(zickZack[0],newZickZack);
	for (i in 1..numberOfSolids-1)
	{
		l = [];
		a = PolyCurve.TangentAtParameter(refLineOuter[i-1][0],1);
		b = PolyCurve.TangentAtParameter(refLineOuter[i][0],0);
		angle = Vector.AngleAboutAxis(a,b,z);
		if (angle < 180)
		{
			l1 = Line.ByStartPointEndPoint(outerEndPoints[i-1],innerEndPoints[i-1]);
			l2 = Line.ByStartPointEndPoint(innerEndPoints[i-1],innerStartPoints[i]);
			l3 = Line.ByStartPointEndPoint(innerStartPoints[i],outerStartPoints[i]);
			l = [l1,l2,l3];
		}
		else
		{
			l = [Line.ByStartPointEndPoint(outerEndPoints[i-1],outerStartPoints[i])];
		}
		newZickZack = List.AddItemToEnd(l,newZickZack);
		newZickZack = List.AddItemToEnd(zickZack[i],newZickZack);
	}


	return newZickZack;
}
};
tzickzack = List.Transpose(List.Flatten(totalZickZack,1));
zzPolyCurve = PolyCurve.ByJoinedCurves(tzickzack,0.001);
# ----------------------------------------
startPoint_2 = Curve.StartPoint(curve=merge_elements.out11)
parameterAtPoint = Curve.ParameterAtPoint(curve=startCurve, point=startPoint_2)
trimByEndParameter = Curve.TrimByEndParameter(curve=startCurve, endParameter=parameterAtPoint)
code_block_15 = CodeBlock(zickZack=merge_elements.out11, middleCurve=create_perimeter_offset_and.out10, firstPart=trimByEndParameter, sideBack=removesides_outer_perimeter.innerBorder, last=code_block_4.out2, connect=byStartPointEndPoint)
# ---------- code_block_15.designscript (5 lines) ----------
p1 = Autodesk.DesignScript.Geometry.Curve.EndPoint(zickZack);
p2 = Autodesk.DesignScript.Geometry.Curve.StartPoint(middleCurve);
zToMid = Line.ByStartPointEndPoint(p1,p2);
l = [firstPart,zickZack,zToMid,middleCurve,sideBack,last,connect];
PolyCurve.ByJoinedCurves(List.Transpose(l),0.01);
# ----------------------------------------
connect_inner_to_outer_path = CodeBlock(accCurve=createAccess.accessCurve, innerPer=code_block_15.out4, outerPath=dictToVar.path, accIdx=dictToVar.accIdx)
# ---------- connect_inner_to_outer_path.designscript (5 lines) ----------
innerPerAcc = List.ReplaceItemAtIndex(accCurve@L2<1>,1,innerPer@L1<1>);
innerPoly = PolyCurve.ByJoinedCurves(innerPerAcc@L2<1>,0.01);
outerPathEx = Geometry.Explode(outerPath);
totalPath = List.ReplaceItemAtIndex(outerPathEx@L2<1>,accIdx,innerPoly@L1<1>);
Autodesk.DesignScript.Geometry.Curve.Join(List.FirstItem(totalPath@L2<1>),List.RestOfItems(totalPath@L2<1>));
# ----------------------------------------

varToDict = Custom[VarToDict](perimeter=code_block_7.out0, path=connect_inner_to_outer_path.out4, accIdx=code_block_7.out1, reversed=create_perimeter_offset_and.out2, numberOfSolids=merge_elements.out3, counter=code_block_7.out1, nozzleD=dictToVar.nozzleD)  # Creates dictionary from Variables
dict_2 = Output(varToDict)  # "dict"
