# Dynamo custom node MultiPerimeterPath.dyf (Dynamo 2.3.0.5885)
# category: 3D-Print
# Creates perimeter path with x inner offsets

perimeter = Input(perimeter: var[]..[])
layerH = Input(layerH: var[]..[])
nozzleD = Input(nozzleD: var[]..[])
position = Input(position: var[]..[])
perimeterPath = Custom[PerimeterPath](Curves=perimeter, layerH=layerH, nozzleD=nozzleD, position=position)  # Creates printing path along geometry perimeter and cuts hole for inter layer connection.
numberOfSolids = Input(numberOfSolids: var[]..[])
code_block = CodeBlock { 0; }
varToDict = Custom[VarToDict](perimeter=perimeterPath.perimeter, path=perimeterPath.printPath, accIdx=perimeterPath.accessIndex, reversed=perimeterPath.reversed, numberOfSolids=numberOfSolids, counter=code_block, nozzleD=nozzleD)  # Creates dictionary from Variables
limit = Input(limit: var[]..[])
counterTest = Custom[CounterTest](Limit=limit)  # test; unwired: dict
singleOutputInnerPath = Custom[SingleOutputInnerPath]()  # Same as InnerPerimeterPath; unwired: dict
loopWhile = LoopWhile(init=varToDict, continueWhile=counterTest, loopBody=singleOutputInnerPath)
dict = Output(loopWhile)
