# Dynamo custom node PerimeterPath.dyf (Dynamo 2.3.0.5885)
# category: 3D-Print
# Creates printing path along geometry perimeter and cuts hole for inter layer connection.

# group: Inputs
Curves = Input(Curves: var[]..[])
nozzleD = Input(nozzleD: var[]..[])
position = Input(position: var[]..[])
layerH = Input(layerH: var[]..[])

firstItem = List.FirstItem(list=Curves@L2)
restOfItems = List.RestOfItems(list=Curves@L2)
join = Curve.Join(curve=firstItem@L1, curves=restOfItems@L2)
code_block = CodeBlock(nozzleD=nozzleD) { off=-nozzleD/2; }
offset = Curve.Offset(curve=join, distance=code_block)
explode = Geometry.Explode(geometry=offset)
code_block_2 = CodeBlock(outerLayer=explode, position=position, nozzleD=nozzleD)
# ---------- code_block_2.designscript (8 lines) ----------
c0=List.GetItemAtIndex(outerLayer@L2<1>,0);
l=Curve.Length(c0);
startP = position - nozzleD*0.75/l;
endP   = position + nozzleD*0.75/l;
trC=Curve.TrimInteriorByParameter(c0,startP,endP);
replacedOL=List.ReplaceItemAtIndex(outerLayer@L2<1>,0,trC@L2<1>);
flattenedOL=List.Flatten(replacedOL@L3<1>,1);
List.ShiftIndices(flattenedOL@L2<1>,-1);
# ----------------------------------------
firstItem_2 = List.FirstItem(list=code_block_2.out7@L2)
restOfItems_2 = List.RestOfItems(list=code_block_2.out7@L2)
join_2 = Curve.Join(curve=firstItem_2@L1, curves=restOfItems_2@L2)

# group: Outputs
perimeter = Output(offset)
printPath = Output(join_2)
code_block_3 = CodeBlock { 1; false; }
accessIndex = Output(code_block_3.out0)
reversed = Output(code_block_3.out1)
