# Dynamo graph PickWall.dyn (Dynamo 2.10.1.3976)

select_model_element_by_category = DSModelElementByCategorySelection(index=686)  # 1 picked in the model
watch = Watch(select_model_element_by_category)
string = StringInput("Length")
getParameterValueByName = Element.GetParameterValueByName(element=watch, parameterName=string)
watch_2 = Watch(getParameterValueByName)
python_script = Python(IN[0]=watch)  # IronPython2
# ---------- python_script.python (18 lines) ----------
import clr

#Import the Revit API
clr.AddReference('RevitAPI')
import Autodesk
from Autodesk.Revit.DB import *

#Start scripting here:

wall = UnwrapElement(IN[0])

#format = FormatOptions(DisplayUnitType.DUT_METERS)

#x = UnitUtils.ConvertFromInternalUnits(wall.Width, format)

#OUT = x

OUT = wall.Width
# ----------------------------------------
convert_between_units = DynamoConvert(python_script, MeasurementType="Length", FromConversion="Feet", ToConversion="Meters")
watch_3 = Watch(convert_between_units)
