# Dynamo custom node Pick_evaluate_adjust.dyf (Dynamo 2.10.1.3976)
# category: Revit
# Pick wall elelements, evaluate optimization opportunity, adjust layers and thicknesses
# packages: Clockwork for Dynamo 2.x 2.3.0

code_block = CodeBlock()
# ---------- code_block.designscript (4 lines) ----------
"Selected walls contain multiple wall types";
"Selected walls already from default 3D printing material, errors could be faces. Check all selected walls material type";
"Selected non-intersecting walls, please try separately or pick continuous element";
"Error 3.1";
# ----------------------------------------
list_create = List.Create(item0=code_block.out0, item1=code_block.out1, item2=code_block.out2)
dict = Input(dict: var[]..[])

# group: Check if multiple wall types selected
name = Custom[Element.Name+](element=dict)  # package Clockwork for Dynamo 2.x; Gets an element's name. Unlike the OOTB node, this node should work for all Revit elements that have names and will also return the localized names of system parameters, parameter groups, display unit types, parameter types, unit symbol types and unit types.
watch = Watch(name)
code_block_2 = CodeBlock { 0; }
getItemAtIndex = List.GetItemAtIndex(list=watch, index=code_block_2)
contains = String.Contains(str=watch, searchFor=getItemAtIndex)
filterByBoolMask = List.FilterByBoolMask(list=watch, mask=contains)
isEmpty = List.IsEmpty(list=filterByBoolMask.out)
multiple_wall_types = Watch(isEmpty)
not_ = Not(x=multiple_wall_types)

firstItem = List.FirstItem(list=name)
Default_Name = Input(Default_Name: var[]..[])
contains_2 = String.Contains(str=firstItem, searchFor=Default_Name)
error_bool_list = List.Create(item0=not_, item1=contains_2)
code_block_3 = CodeBlock { true; }
allIndicesOf = List.AllIndicesOf(list=error_bool_list, item=code_block_3)
getItemAtIndex_2 = List.GetItemAtIndex(list=list_create, index=allIndicesOf)
watch_2 = Watch(getItemAtIndex_2)
Error_Text = Output(watch_2)
or_ = Or(bool0=not_, bool1=contains_2)
Error = Output(or_)
Elements_name = Output(name)
Elements = Output(dict)
watch_3 = Watch(dict)
second_input = CodeBlock { false; }
number = DoubleInput(2)
combinations = List.Combinations(list=dict, length=number)
watch_4 = Watch(combinations)
transpose = List.Transpose(lists=combinations)
code_block_4 = CodeBlock(x=transpose) { x[0]; x[1]; }
watch_5 = Watch(code_block_4.out0)
geometry = Element.Geometry(element=watch_5)
watch_6 = Watch(code_block_4.out1)
geometry_2 = Element.Geometry(element=watch_6)
doesIntersect = Geometry.DoesIntersect(geometry=geometry, other=geometry_2)
flatten = List.Flatten(list=doesIntersect)
filterByBoolMask_2 = List.FilterByBoolMask(list=combinations, mask=flatten)
watch_7 = Watch(filterByBoolMask_2.out)
watch_8 = Watch(filterByBoolMask_2.in)
transpose_2 = List.Transpose(lists=watch_8)
watch_9 = Watch(transpose_2)
