# Dynamo graph PrintedGeometry_clean.dyn (Dynamo 2.10.1.3976)
# packages: Clockwork for Dynamo 2.x 2.3.0, Data-Shapes 2022.2.103

code_block = CodeBlock { null; 0; }

# group: Pick Elements
select_model_elements_by = DSModelElementsByCategorySelection(index=686)  # "Select Model Elements By Category"; 3 picked in the model
watch = Watch(select_model_elements_by)

default_am_material_name = CodeBlock { "3D_Printing_Layer_Proposal"; }

# group: Evaluate selected walls
pick_evaluate_adjust = Custom[Pick_evaluate_adjust](dict=watch, Default_Name=default_am_material_name)  # Pick wall elelements, evaluate optimization opportunity, adjust layers and thicknesses
code_block_2 = CodeBlock { null; }
if_ = If(test=pick_evaluate_adjust.Error, true=code_block_2, false=pick_evaluate_adjust.Elements)
watch_2 = Watch(pick_evaluate_adjust.Elements_name)
alert_Popout = Custom[Alert_Popout](Error=pick_evaluate_adjust.Error, Error_Text=pick_evaluate_adjust.Error_Text)  # Show alerts from the code

# group: Thicknesses update
update_thicknesses = Custom[Update_thicknesses](dict=if_, name=default_am_material_name)  # Updating thicknesses of selected elements
watch_3 = Watch(update_thicknesses.Wall_Thickness)
watch_4 = Watch(if_)
code_block_3 = CodeBlock(a=update_thicknesses.Initial_Total_Wall_Thickness, b=update_thicknesses.Initial_Structural_Thickness) { a; b; structureVolumeShare = b/a; }

# group: Extract Solid and necessary parameters from Wall
geometry = Element.Geometry(element=update_thicknesses.Elements)
flatten = List.Flatten(list=geometry)
byUnion = Solid.ByUnion(solids=flatten)
byGeometry = BoundingBox.ByGeometry(geom=byUnion)
maxPoint = BoundingBox.MaxPoint(boundingBox=byGeometry)
Z = Point.Z(point=maxPoint)
extract_height_and_width = CodeBlock(element=update_thicknesses.Elements)
# ---------- extract_height_and_width.designscript (4 lines) ----------
firstE = List.FirstItem(element);
height = Element.GetParameterValueByName(firstE,"Unconnected Height");
type = Element.GetParameterValueByName(firstE, "Type");
width = Element.GetParameterValueByName(type, "Width");
# ----------------------------------------
number_of_wall_parts = List.Count(list=flatten)
centerSurface = Custom[CenterSurface](wallSolid=byUnion, wallWidth=extract_height_and_width.width)  # Extracts center surface of a solid

# group: Parametric Input
reduce_height_for_testing_m = DoubleSlider(2.81, range=0..3 step 0.01)
zigzag_angle = IntegerSlider(45, range=45..60 step 1)
displacement_step = DoubleSlider(0, range=-1..1 step 0.1)
create_insert = BoolSelector(true)
in_which_solid_create_insert = DoubleSlider(1, range=0..5 step 1)
in_which_zigzag = DoubleSlider(4, range=0..10 step 1)
insert_width_adjustment = DoubleSlider(2, range=1..5 step 0.2)

# group: Layers by intersection with xy-Planes
string = StringInput("layerH")
findByName = GlobalParameter.FindByName(name=string)
value = GlobalParameter.Value(globalParameter=findByName)
create_planes_for_intersection = CodeBlock(layerH=value, height=Z, redH=reduce_height_for_testing_m, wallSolid=byUnion, wallThickness=extract_height_and_width.width)
# ---------- create_planes_for_intersection.designscript (28 lines) ----------
planeZ=layerH..height-redH..layerH;
o=Point.ByCoordinates(0,0,planeZ);
planesT=Plane.ByOriginNormal(o,Vector.ZAxis());
// if plane is at uppermost position of the geometry, intersection causes errors
z=List.LastItem(planeZ);
p=Point.ByCoordinates(0,0,z-0.001);
planes = [Imperative]{
if (z != height) {
return planesT;
}
else {
newPlane=Plane.ByOriginNormal(p,Vector.ByCoordinates(0,0,1));
i=List.IndexOf(planesT,List.LastItem(planesT));
return List.ReplaceItemAtIndex(planesT,i,newPlane);
};
};
// cut geometry with horizontal planes
horizontalCut = List.Flatten(Geometry.Intersect(wallSolid,planes),-1);
curves = Surface.PerimeterCurves(horizontalCut);
// shift longest side to idx 0
l = Curve.Length(curves);
maxL = List.MaximumItem(l);
idxMax = -List.IndexOf(l@L2<1>, maxL@L1<1>);
curveList = List.ShiftIndices(curves@L2<1>, idxMax@L1<1>);
// if there are more than one longest curves:
test = ((List.FirstItem(curveList).Length) - wallThickness) > 0.0001;
shift = 1 - (List.FirstIndexOf(test, false));
List.ShiftIndices(curveList@L2<1>, shift);
# ----------------------------------------
geometry_intersect_center = Geometry.Intersect(geometry=centerSurface.centerSurface, other=create_planes_for_intersection.out5)  # "Geometry.Intersect: center surface"

# group: Pathplanning
number_of_extra_perimeters = IntegerSlider(0, range=0..5 step 1)
opening_position = DoubleSlider(0.5, range=0.02..1 step 0.01)
get_printer_parameters = CodeBlock()
# ---------- get_printer_parameters.designscript (4 lines) ----------
lH = GlobalParameter.FindByName("layerH");
GlobalParameter.Value(lH);
nD = GlobalParameter.FindByName("nozzleD");
GlobalParameter.Value(nD);
# ----------------------------------------
multiPerimeterPath = Custom[MultiPerimeterPath](perimeter=create_planes_for_intersection.out14, numberOfSolids=number_of_wall_parts, limit=number_of_extra_perimeters, position=opening_position, layerH=get_printer_parameters.out1, nozzleD=get_printer_parameters.out3)  # Creates perimeter path with x inner offsets
innerZickZack = Custom[InnerZickZack](dict=multiPerimeterPath, wall_thickness=watch_3, angle=zigzag_angle, Displacement=displacement_step)  # frozen; Creates an inner zick zack path from a perimeter path.
number_of_divisions = IntegerSlider(60, range=4..100 step 2)
innerRibs = Custom[InnerRibs](dict=multiPerimeterPath, divisions=number_of_divisions)  # frozen
dictToVar = Custom[DictToVar](dict=innerRibs)  # Extracts dictionary content

code_block_4 = CodeBlock(dict=multiPerimeterPath) { dict: var[]..[]; }
dictToVar_2 = Custom[DictToVar](dict=code_block_4)

# group: inner Zick Zack
createAccess = Custom[CreateAccess](nozzleD=dictToVar_2.nozzleD, outerPrintingPath=dictToVar_2.path, accessIdx=dictToVar_2.accIdx)  # Cuts surrounding printing path at access point and returns access geometry
create_perimeter_offset_and = CodeBlock(perimeter=dictToVar_2.perimeter, nozzleD=dictToVar_2.nozzleD, reversed=dictToVar_2.reversed, nos=dictToVar_2.numberOfSolids)  # "Create perimeter offset and reverse it if necessary"
# ---------- create_perimeter_offset_and.designscript (34 lines) ----------
offPer = Autodesk.DesignScript.Geometry.Curve.Offset(perimeter,-nozzleD);
exPer = Geometry.Explode(offPer);
!reversed;
nos;
outerPer = [Imperative]{
if (!reversed)
{
reverted=[];
for (i in 0..List.Count(exPer)-1)
{
reverted[i]=List.Reverse(exPer[i]);
}
return PolyCurve.Reverse(reverted);
}
else
{
return exPer;
}
};
shiftIdx = [Imperative]{
if (!reversed)
{
return 1;
}
else
{
return nos-1;
}
};
outer = List.ShiftIndices(outerPer@L2<1>,shiftIdx);
outerPoly = PolyCurve.ByJoinedCurves(outer,0.0001);
offOuter = Autodesk.DesignScript.Geometry.Curve.Offset(outerPoly,-nozzleD);
inner = Geometry.Explode(offOuter);
middleCurve = List.GetItemAtIndex(outer@L2<1>,nos);
# ----------------------------------------
removesides_outer_perimeter = Custom[RemoveSides Outer Perimeter](geometry=create_perimeter_offset_and.out6, numberOfSolids=dictToVar_2.numberOfSolids)  # Removes the sides of a perimeter curve by bool mask.
code_block_5 = CodeBlock(c=removesides_outer_perimeter.outerBorder, nozzleD=dictToVar_2.nozzleD)
# ---------- code_block_5.designscript (4 lines) ----------
curves = PolyCurve.Curves(c);
len = Autodesk.DesignScript.Geometry.Curve.Length(curves);
off1 = nozzleD/len;
off2 = 1-off1;
# ----------------------------------------
trimByParameter = Curve.TrimByParameter(curve=code_block_5.curves@L2, startParameter=code_block_5.off1@L2, endParameter=code_block_5.off2@L2)
transpose = List.Transpose(lists=trimByParameter)
removesides_offset_perimeter = Custom[RemoveSides Offset Perimeter](geometry=create_perimeter_offset_and.out9, numberOfSolids=dictToVar_2.numberOfSolids)  # Removes the sides of a perimeter curve by bool mask.
code_block_6 = CodeBlock(c=removesides_offset_perimeter.innerBorder, nozzleD=dictToVar_2.nozzleD)  # same code as code_block_5
trimByParameter_2 = Curve.TrimByParameter(curve=code_block_6.curves@L2, startParameter=code_block_6.off1@L2, endParameter=code_block_6.off2@L2)
transpose_2 = List.Transpose(lists=trimByParameter_2)
code_block_7 = CodeBlock { 2; 1; }
startPoint = Curve.StartPoint(curve=trimByParameter@L2)
transpose_3 = List.Transpose(lists=startPoint)
endPoint = Curve.EndPoint(curve=trimByParameter@L2)
transpose_4 = List.Transpose(lists=endPoint)
startCurve = Custom[StartCurve](perimeter=dictToVar_2.perimeter, reverse=dictToVar_2.reversed, numberOfSolids=dictToVar_2.numberOfSolids, nozzleD=dictToVar_2.nozzleD)  # Creates a offset curve that connects to the outer perimeter
code_block_8 = CodeBlock(geo=create_perimeter_offset_and.out6, nozzleD=dictToVar_2.nozzleD)
# ---------- code_block_8.designscript (3 lines) ----------
c=List.LastItem(geo@L2<1>);
startPar=1-nozzleD/Autodesk.DesignScript.Geometry.Curve.Length(c);
Autodesk.DesignScript.Geometry.Curve.TrimByEndParameter(c,startPar);
# ----------------------------------------
endPoint_2 = Curve.EndPoint(curve=code_block_8.out2)
byStartPointEndPoint = Line.ByStartPointEndPoint(startPoint=endPoint_2, endPoint=createAccess.accessPoint)

code_block_9 = CodeBlock(x=create_perimeter_offset_and.out9) { x; y=x[0]; }
code_block_10 = CodeBlock(y=code_block_9.y, NumberOfSolids=dictToVar_2.numberOfSolids) { y[0..(NumberOfSolids-1)]; }
direction = Line.Direction(line=code_block_10)
code_block_11 = CodeBlock(wall_thickness=watch_3) { wall_thickness: var[]..[]; }
code_block_12 = CodeBlock(angle=zigzag_angle) { angle: var[]..[]; }

# group: Tan zigzag angle and step functionality
watch_5 = Watch(transpose)
length = Curve.Length(curve=watch_5)
compensate_zigzag_location_in = CodeBlock(x=code_block_11, y=dictToVar_2.nozzleD) { x-(4*y); }  # "Compensate zigzag location in center"
tan = Math.Tan(angle=code_block_12)
watch_6 = Watch(tan)
division_distance_between_two = compensate_zigzag_location_in / watch_6  # "Division - Distance between two points"
division_number_of_splits_for = length / division_distance_between_two  # "Division - number of splits for each curve"
round_to_the_nearest_even_number = CodeBlock(a=division_number_of_splits_for) { Math.Round(a/2)*2; }
watch_7 = Watch(round_to_the_nearest_even_number)
pointsAtEqualSegmentLength = Curve.PointsAtEqualSegmentLength(curve=transpose, divisions=watch_7)
code_block_13 = CodeBlock { 0; }
list_getitematindex_seems_to_be = List.GetItemAtIndex(list=watch_7@L2, index=code_block_13)  # "List.GetItemAtIndex - Seems to be more efficient"
watch_8 = Watch(pointsAtEqualSegmentLength)
list_flatten_possible_to_use = List.Flatten(list=watch_7)  # "List.Flatten Possible to use both 1st and second implementation"
code_block_14 = CodeBlock(PointsInput=list_flatten_possible_to_use)
# ---------- code_block_14.designscript (15 lines) ----------
PointsInput;
LastValue = PointsInput[0];
PointsUnique = [Imperative]{
unique = [];
unique = List.AddItemToEnd(PointsInput[0], unique);
for (i in 0..(List.Count(PointsInput)-1))
{
	if(PointsInput[i] != LastValue)
	{
		unique = List.AddItemToEnd(PointsInput[i], unique);
		LastValue = PointsInput[i];
	}
}
return unique;
};
# ----------------------------------------
transpose_5 = List.Transpose(lists=code_block_14.out2)
watch_9 = Watch(code_block_14.out2)
watch_10 = Watch(code_block_14.out1)

# group: Distance between points in each solid
code_block_15 = CodeBlock(input=pointsAtEqualSegmentLength, numberOfSolids=dictToVar_2.numberOfSolids)
# ---------- code_block_15.designscript (11 lines) ----------
input;
numberOfSolids;

distanceBetweenPoints = [Imperative]{
distance = [];
for (i in 0..numberOfSolids-1)
{
	distance[i] = Geometry.DistanceTo(input[i][0][0],input[i][0][1]);
}
return distance;
};
# ----------------------------------------

code_block_16 = CodeBlock(Displacement=displacement_step) { Displacement: var[]..[]; }

# group: Zigzag displacement
code_block_17 = CodeBlock(direction=direction, distance=code_block_15.out2, numberOfSolids=dictToVar_2.numberOfSolids, displacement=code_block_16, original=pointsAtEqualSegmentLength, numberPerSolid=list_getitematindex_seems_to_be)
# ---------- code_block_17.designscript (44 lines) ----------
direction;
distance;
numberOfSolids;
displacement;
original;
numberPerSolid;


geometry = original;
listCountInside = List.Count(geometry[0]);
listCount = List.Count(geometry@L2<1>);
listLength = List.Count(listCount);


translatedPoints = [Imperative]{

	if (displacement == 0)
	{
		return original;
	}
	else
	{
		points = [];
		for (n in 0..numberOfSolids-1)
		{
			for (i in 0..(listLength/numberOfSolids)-1)
			{
				// Keep first two points untouched
				points[n][i][0] = geometry[n][i][0];
				points[n][i][1] = geometry[n][i][1];
				// Keep last two points untouched
				points[n][i][numberPerSolid[n]-1-1] = geometry[n][i][numberPerSolid[n]-1-1];
				points[n][i][numberPerSolid[n]-2-1] = geometry[n][i][numberPerSolid[n]-2-1];

				// Move all other points
				for (j in 2..numberPerSolid[n]-3-1)
				{
					points[n][i][j] = Geometry.Translate(geometry[n][i][j],direction[n],distance[n]*displacement);
				}
			}
		}
		return points;
	}
};
# ----------------------------------------

# group (continued): inner Zick Zack
closestPointTo = Geometry.ClosestPointTo(geometry=transpose_2, other=code_block_17.out10)
transpose_6 = List.Transpose(lists=closestPointTo@L3)
dropEveryNthItem = List.DropEveryNthItem(list=transpose_6@L3, n=code_block_7.out0)
transpose_7 = List.Transpose(lists=code_block_17.out10@L3)
dropEveryNthItem_2 = List.DropEveryNthItem(list=transpose_7@L3, n=code_block_7.out0, offset=code_block_7.out1)
byStartPointEndPoint_2 = Line.ByStartPointEndPoint(startPoint=dropEveryNthItem, endPoint=dropEveryNthItem_2)
restOfItems = List.RestOfItems(list=dropEveryNthItem@L3)
byStartPointEndPoint_3 = Line.ByStartPointEndPoint(startPoint=dropEveryNthItem_2, endPoint=restOfItems)
firstItem = List.FirstItem(list=dropEveryNthItem@L3)
byStartPointEndPoint_4 = Line.ByStartPointEndPoint(startPoint=transpose_3, endPoint=firstItem)
lastItem = List.LastItem(list=dropEveryNthItem@L3)
byStartPointEndPoint_5 = Line.ByStartPointEndPoint(startPoint=lastItem, endPoint=transpose_4)
merge_zick_zack_lines_per = CodeBlock(linesDown=byStartPointEndPoint_2, linesUp=byStartPointEndPoint_3, numberOfSolids=dictToVar_2.numberOfSolids, numberOfLines=list_getitematindex_seems_to_be, linesStart=byStartPointEndPoint_4, linesEnd=byStartPointEndPoint_5)  # "Merge zick zack lines per element"
# ---------- merge_zick_zack_lines_per.designscript (22 lines) ----------
linesDown;
linesUp;
numberOfSolids;
numberOfLines;
linesStart;
linesEnd;
linesTotal = [Imperative]{
lines = [];
for (i in 0..numberOfSolids-1)
{
	l = [];
	l[0]=linesStart[i];
	for (j in 0..(numberOfLines[i]/2-2))
	{
		l[2*j+1] = linesDown[i][j];
		l[2*j+2] = linesUp[i][j];
	}
	l[numberOfLines[i]-1] = linesEnd[i];
	lines = List.AddItemToEnd(l,lines);
}
return lines;
};
# ----------------------------------------
merge_elements = CodeBlock(refLineOuter=transpose, refLineInner=transpose_2, zickZack=merge_zick_zack_lines_per.out6, numberOfSolids=dictToVar_2.numberOfSolids)
# ---------- merge_elements.designscript (45 lines) ----------
refLineOuter;
refLineInner;
zickZack;
numberOfSolids;
z = Vector.ZAxis();
outerEndPoints = Autodesk.DesignScript.Geometry.Curve.EndPoint(refLineOuter);
outerStartPoints = Autodesk.DesignScript.Geometry.Curve.StartPoint(refLineOuter);
innerEndPoints = Autodesk.DesignScript.Geometry.Curve.EndPoint(refLineInner);
innerStartPoints = Autodesk.DesignScript.Geometry.Curve.StartPoint(refLineInner);

totalZickZack = [Imperative]{
if (numberOfSolids == 1)
{
	return zickZack;
}
else {
	newZickZack=[];
	newZickZack = List.AddItemToEnd(zickZack[0],newZickZack);
	for (i in 1..numberOfSolids-1)
	{
		l = [];
		a = PolyCurve.TangentAtParameter(refLineOuter[i-1][0],1);
		b = PolyCurve.TangentAtParameter(refLineOuter[i][0],0);
		angle = Vector.AngleAboutAxis(a,b,z);
		if (angle < 180)
		{
			l1 = Line.ByStartPointEndPoint(outerEndPoints[i-1],innerEndPoints[i-1]);
			l2 = Line.ByStartPointEndPoint(innerEndPoints[i-1],innerStartPoints[i]);
			l3 = Line.ByStartPointEndPoint(innerStartPoints[i],outerStartPoints[i]);
			l = [l1,l2,l3];
		}
		else
		{
			l = [Line.ByStartPointEndPoint(outerEndPoints[i-1],outerStartPoints[i])];
		}
		newZickZack = List.AddItemToEnd(l,newZickZack);
		newZickZack = List.AddItemToEnd(zickZack[i],newZickZack);
	}


	return newZickZack;
}
};
tzickzack = List.Transpose(List.Flatten(totalZickZack,1));
zzPolyCurve = PolyCurve.ByJoinedCurves(tzickzack,0.001);
# ----------------------------------------
startPoint_2 = Curve.StartPoint(curve=merge_elements.out11)
parameterAtPoint = Curve.ParameterAtPoint(curve=startCurve, point=startPoint_2)
trimByEndParameter = Curve.TrimByEndParameter(curve=startCurve, endParameter=parameterAtPoint)

code_block_18 = CodeBlock(innerBorder=removesides_outer_perimeter.innerBorder, createInsert=create_insert, insertSolid=in_which_solid_create_insert, insertZigzag=in_which_zigzag, centerPoints=closestPointTo, nozzleD=dictToVar_2.nozzleD, insertWidth=insert_width_adjustment, outerPathEx=dictToVar_2.path)
# ---------- code_block_18.designscript (53 lines) ----------
innerBorder;
innerBorderPerSolid = Geometry.Explode(innerBorder);

createInsert;
insertSolid;
insertZigzag;
centerPoints;
nozzleD;
insertWidth;

countInside = List.Count(innerBorder);
updatedCurves =[];
pointFront = [];
pointBack = [];
pointCenter = [];
arc = [];
splitCurve = [];
newCurve = [];
result = [];
closestPoints = [];

inputPath = innerBorderPerSolid;
inputPathOuter = Geometry.Explode(outerPathEx);

polyInsertInner = [Imperative]{
	if (createInsert == false)
	{
		return innerBorderPerSolid;
	}
	else
	{
		for (i in 0..countInside-1)
			{
				updatedCurves[i] = inputPath[i][insertSolid];
				closestPoints[i] = Geometry.ClosestPointTo(updatedCurves[i], centerPoints[insertSolid][0]);

				updatedCurvesOut[i] = inputPathOuter[i][2+insertSolid];
				closestPointsOut[i] = Geometry.ClosestPointTo(updatedCurvesOut[i], centerPoints[insertSolid][0]);

				pointCenter[i] = closestPoints[i][insertZigzag*2+1];
				pointCenterOut[i] = closestPointsOut[i][insertZigzag*2+1];
				pointFront[i] = Geometry.Translate(closestPoints[i][insertZigzag*2+2], Vector.ByTwoPoints(closestPoints[i][insertZigzag*2+2],pointCenter[i]),insertWidth*nozzleD);
				pointBack[i] = Geometry.Translate(closestPoints[i][insertZigzag*2], Vector.ByTwoPoints(closestPoints[i][insertZigzag*2],pointCenter[i]),insertWidth*nozzleD);
 				arc[i] = Arc.ByCenterPointStartPointEndPoint(pointCenterOut[i], pointFront[i], pointBack[i]);
				splitCurve[i] = updatedCurves[i].SplitByPoints([pointFront[i], pointBack[i]]);
				newCurve[i] = PolyCurve.ByJoinedCurves(List.ReplaceItemAtIndex(splitCurve[i], 1, arc[i]), 0.001);
				result[i] = List.ReplaceItemAtIndex(inputPath[i], insertSolid, newCurve[i]);
			}
		return result;
	}
};

newInnerBorder = PolyCurve.ByJoinedCurves(polyInsertInner@L2<1>, 0.01);
# ----------------------------------------

# group (continued): inner Zick Zack
code_block_19 = CodeBlock(zickZack=merge_elements.out11, middleCurve=create_perimeter_offset_and.out10, firstPart=trimByEndParameter, sideBack=code_block_18.out21, last=code_block_8.out2, connect=byStartPointEndPoint)
# ---------- code_block_19.designscript (5 lines) ----------
p1 = Autodesk.DesignScript.Geometry.Curve.EndPoint(zickZack);
p2 = Autodesk.DesignScript.Geometry.Curve.StartPoint(middleCurve);
zToMid = Line.ByStartPointEndPoint(p1,p2);
l = [firstPart,zickZack,zToMid,middleCurve,sideBack,last,connect];
PolyCurve.ByJoinedCurves(List.Transpose(l),0.01);
# ----------------------------------------

code_block_20 = CodeBlock { 0; }
list_getitematindex_seems_to_be_2 = List.GetItemAtIndex(list=length@L2, index=code_block_20)  # "List.GetItemAtIndex - Seems to be more efficient"

# group (continued): inner Zick Zack
create_insert_and_connect_inner = CodeBlock(accCurve=createAccess.accessCurve, innerPer=code_block_19.out4, outerPath=dictToVar_2.path, createInsert=create_insert, insertSolid=in_which_solid_create_insert, insertZigzag=in_which_zigzag, totalZigzags=list_getitematindex_seems_to_be, distanceBetweenZigzags=code_block_15.out2, curveLengths=list_getitematindex_seems_to_be_2, centerPoints=closestPointTo, nozzleD=dictToVar_2.nozzleD, direction=direction, insertWidth=insert_width_adjustment, accIdx=dictToVar_2.accIdx)  # "Create insert and Connect inner to outer path"
# ---------- create_insert_and_connect_inner.designscript (71 lines) ----------
innerPerAcc = List.ReplaceItemAtIndex(accCurve@L2<1>,1,innerPer@L1<1>);

outerPathEx = Geometry.Explode(outerPath);
createInsert;
insertSolid;
insertZigzag;
totalZigzags;
distanceBetweenZigzags;
curveLengths;
centerPoints;
nozzleD;
direction;
insertWidth;

countInside = List.Count(innerPerAcc);
insertCenter = (insertZigzag*2+2)*distanceBetweenZigzags[insertSolid]/curveLengths[insertSolid];
 // not compensated if zigzag displaced;

inputPath = outerPathEx;
updatedCurves =[];
pointFront = [];
pointBack = [];
pointCenter = [];
arc = [];
splitCurve = [];
newCurve = [];
result = [];
closestPoints = [];

polyInsertOuter = [Imperative]{
	if (createInsert == false)
	{
		return outerPathEx;
	}
	else
	{
		for (i in 0..countInside-1)
			{
				updatedCurves[i] = inputPath[i][2+insertSolid];
				closestPoints[i] = Geometry.ClosestPointTo(updatedCurves[i], centerPoints[insertSolid][0]);
				pointCenter[i] = closestPoints[i][insertZigzag*2+1];
				pointFront[i] = Geometry.Translate(closestPoints[i][insertZigzag*2+2], Vector.ByTwoPoints(closestPoints[i][insertZigzag*2+2],pointCenter[i]),(insertWidth+1)*nozzleD);
				pointBack[i] = Geometry.Translate(closestPoints[i][insertZigzag*2], Vector.ByTwoPoints(closestPoints[i][insertZigzag*2],pointCenter[i]),(insertWidth+1)*nozzleD);
 				arc[i] = Arc.ByCenterPointStartPointEndPoint(pointCenter[i], pointFront[i], pointBack[i]);
				splitCurve[i] = updatedCurves[i].SplitByPoints([pointFront[i], pointBack[i]]);
				newCurve[i] = PolyCurve.ByJoinedCurves(List.ReplaceItemAtIndex(splitCurve[i], 1, arc[i]), 0.001);
				result[i] = List.ReplaceItemAtIndex(inputPath[i], 2+insertSolid, newCurve[i]);
			}
		return result;
	}
};

// 1st bug explanation https://github.com/DynamoDS/Dynamo/issues/6620












innerPoly = PolyCurve.ByJoinedCurves(innerPerAcc@L2<1>,0.01);



totalPath = List.ReplaceItemAtIndex(polyInsertOuter@L2<1>,accIdx,innerPoly@L1<1>);
Autodesk.DesignScript.Geometry.Curve.Join(List.FirstItem(totalPath@L2<1>),List.RestOfItems(totalPath@L2<1>));
# ----------------------------------------

varToDict = Custom[VarToDict](perimeter=code_block.out0, path=create_insert_and_connect_inner.out27, accIdx=code_block.out1, reversed=create_perimeter_offset_and.out2, numberOfSolids=merge_elements.out3, counter=code_block.out1, nozzleD=dictToVar_2.nozzleD)  # frozen; Creates dictionary from Variables

# group (continued): Pathplanning
dictToVar_3 = Custom[DictToVar](dict=varToDict)

# group: extract printing path points for robot control
explode = Geometry.Explode(geometry=dictToVar_3.path)
number_slider = DoubleSlider(0.1, range=0.01..0.5 step 0.01)
length_2 = Curve.Length(curve=explode)
code_block_21 = CodeBlock(x=number_slider, y=length_2) { a=x/y; 0..1..a; }
splitByParameter = Curve.SplitByParameter(curve=explode, parameters=code_block_21.out1)
endPoint_3 = Curve.EndPoint(curve=splitByParameter)
flatten_2 = List.Flatten(list=endPoint_3)
byPoints = PolyCurve.ByPoints(points=flatten_2)
explode_2 = Geometry.Explode(geometry=byPoints)

# group: Translate to Origin
minPoint = BoundingBox.MinPoint(boundingBox=byGeometry)
code_block_22 = CodeBlock(p=minPoint) { -Point.X(p); -Point.Y(p); }
translate = Geometry.Translate(geometry=dictToVar_3.path, xTranslation=code_block_22.out0, yTranslation=code_block_22.out1)

# group: path finish and solid sweep, does not always work and takes some time to execute
drawPrintedGeometry = Custom[DrawPrintedGeometry]()  # frozen; Creates a solid from a printing path by swiping a cross section along the path.; unwired: printingPath, nozzleD, layerH
get_printer_parameters_2 = CodeBlock()  # frozen; same code as get_printer_parameters
input_and_inter_layer_curves = CodeBlock(curve=translate)  # frozen
# ---------- input_and_inter_layer_curves.designscript (6 lines) ----------
curve;
List.FirstItem(PolyCurve.NumberOfCurves(curve));
nol = List.Count(curve)-1;
p1 = List.TakeItems(Curve.EndPoint(curve),nol);
p2 = List.RestOfItems(Curve.StartPoint(curve));
Line.ByStartPointEndPoint(p1,p2);
# ----------------------------------------
explode_3 = Geometry.Explode(geometry=input_and_inter_layer_curves.curve)
regularCrossSection = Custom[RegularCrossSection](nozzleSize=get_printer_parameters_2.out3, layerThickness=get_printer_parameters_2.out1, geometry=explode_3@L2, numberOfCurves=input_and_inter_layer_curves.out1)  # Creates a cross section of a 3D printing layer
startPoint_3 = Curve.StartPoint(curve=regularCrossSection.revolveCrossSection)
code_block_23 = CodeBlock { 360; }
byRevolve = Solid.ByRevolve(profile=regularCrossSection.revolveCrossSection@L2, axisOrigin=startPoint_3@L2, sweepAngle=code_block_23)
byUnion_2 = Solid.ByUnion(solids=byRevolve@L2)
byUnion_3 = Solid.ByUnion(solids=byUnion_2)
bySweep = Solid.BySweep(profile=regularCrossSection.crossSection, path=explode_3)
byUnion_4 = Solid.ByUnion(solids=bySweep)
byUnion_5 = Solid.ByUnion(solids=byUnion_4)
union = Solid.Union(solid=byUnion_3, solid_2=byUnion_5)
join = List.Join()  # frozen; unwired: list0, list1
code_block_24 = CodeBlock(endCS=regularCrossSection.crossSection, nol=input_and_inter_layer_curves.nol) { List.RestOfItems(List.FirstItem(endCS@L2<1>)); List.TakeItems(List.Flatten(ilCS,-1),nol); }  # unwired: ilCS
combine = List.Combine(comb=join, list1=code_block_24.out1, list2=code_block_24.out0)
byLoft = Solid.ByLoft(crossSections=combine)
byUnion_6 = Solid.ByUnion(solids=byLoft)
union_2 = Solid.Union(solid=union, solid_2=byUnion_6)
volume = Solid.Volume(solid=union_2)
code_block_25 = CodeBlock { 0; 1; 2; 2.5; 5; }  # frozen
byCoordinates = Point.ByCoordinates(x=code_block_25.out2, y=code_block_25.out0, z=code_block_25.out0)
byCoordinates_2 = Point.ByCoordinates(x=code_block_25.out4, y=code_block_25.out3, z=code_block_25.out1)
byCorners = Cuboid.ByCorners(lowPoint=byCoordinates, highPoint=byCoordinates_2)
differenceAll = Solid.DifferenceAll(solid=byCorners, others=byUnion_5)
differenceAll_2 = Solid.DifferenceAll(solid=differenceAll, others=byUnion_6)
differenceAll_3 = Solid.DifferenceAll(solid=byCorners, others=differenceAll_2)

# group: Parameters
string_2 = StringInput("nozzleD")
select_parameter_type = ParameterType()  # nothing selected
byName = GlobalParameter.ByName(name=string_2, parameterType=select_parameter_type)
nozzle_size_m = DoubleSlider(0.03, range=0.01..0.4 step 0.005)
setValue = GlobalParameter.SetValue(parameter=byName, value=nozzle_size_m)
string_3 = StringInput("layerH")
select_parameter_type_2 = ParameterType()  # nothing selected
byName_2 = GlobalParameter.ByName(name=string_3, parameterType=select_parameter_type_2)
layer_thickness_m = DoubleSlider(0.025, range=0.01..0.4 step 0.005)
setValue_2 = GlobalParameter.SetValue(parameter=byName_2, value=layer_thickness_m)

code_block_26 = CodeBlock { null; 0; }
dictToVar_4 = Custom[DictToVar]()  # frozen; unwired: dict
number_of_divisions_2 = IntegerSlider(80, range=4..100 step 2)

# group: inner Zick Zack ... DEBUG
createAccess_2 = Custom[CreateAccess](nozzleD=dictToVar_4.nozzleD, outerPrintingPath=dictToVar_4.path, accessIdx=dictToVar_4.accIdx)
create_perimeter_offset_and_2 = CodeBlock(perimeter=dictToVar_4.perimeter, nozzleD=dictToVar_4.nozzleD, reversed=dictToVar_4.reversed, nos=dictToVar_4.numberOfSolids)  # "Create perimeter offset and reverse it if necessary"; same code as create_perimeter_offset_and
removeSides = Custom[RemoveSides](geometry=create_perimeter_offset_and_2.out6, numberOfSolids=dictToVar_4.numberOfSolids)  # Removes the sides of a perimeter curve by bool mask.
code_block_27 = CodeBlock(c=removeSides.outerBorder, nozzleD=dictToVar_4.nozzleD)  # same code as code_block_5
trimByParameter_3 = Curve.TrimByParameter(curve=code_block_27.curves@L2, startParameter=code_block_27.off1@L2, endParameter=code_block_27.off2@L2)
transpose_8 = List.Transpose(lists=trimByParameter_3)
pointsAtEqualSegmentLength_2 = Curve.PointsAtEqualSegmentLength(curve=transpose_8, divisions=number_of_divisions_2)
removeSides_2 = Custom[RemoveSides](geometry=create_perimeter_offset_and_2.out9, numberOfSolids=dictToVar_4.numberOfSolids)
code_block_28 = CodeBlock(c=removeSides_2.innerBorder, nozzleD=dictToVar_4.nozzleD)  # same code as code_block_5
trimByParameter_4 = Curve.TrimByParameter(curve=code_block_28.curves@L2, startParameter=code_block_28.off1@L2, endParameter=code_block_28.off2@L2)
transpose_9 = List.Transpose(lists=trimByParameter_4)
closestPointTo_2 = Geometry.ClosestPointTo(geometry=transpose_9, other=pointsAtEqualSegmentLength_2)
byStartPointEndPoint_6 = Line.ByStartPointEndPoint(startPoint=pointsAtEqualSegmentLength_2, endPoint=closestPointTo_2)
code_block_29 = CodeBlock { 2; 1; }
takeEveryNthItem = List.TakeEveryNthItem(list=byStartPointEndPoint_6@L2, n=code_block_29.out0, offset=code_block_29.out1)
takeEveryNthItem_2 = List.TakeEveryNthItem(list=byStartPointEndPoint_6@L2, n=code_block_29.out0)
count = List.Count(list=pointsAtEqualSegmentLength_2@L2)
code_block_30 = CodeBlock(x=count) { x-1; }
takeItems = List.TakeItems(list=pointsAtEqualSegmentLength_2@L2, amount=code_block_30@L1)
restOfItems_2 = List.RestOfItems(list=pointsAtEqualSegmentLength_2@L2)
distanceTo = Geometry.DistanceTo(geometry=takeItems@L2, other=restOfItems_2@L2)
code_block_31 = CodeBlock(dist=distanceTo, nozzleD=dictToVar_4.nozzleD, c=takeEveryNthItem_2)
# ---------- code_block_31.designscript (8 lines) ----------
fdist = List.Flatten(dist);
r = Math.Round(List.FirstItem(fdist),4) - nozzleD/2;
l = Curve.Length(c);
par = r/l;
vec1 = Line.Direction(c);
vec2 = Vector.YAxis();
angle1 = Vector.AngleWithVector(vec1,vec2) - 180;
angle2 = angle1 + 180;
# ----------------------------------------
trimByStartParameter = Curve.TrimByStartParameter(curve=takeEveryNthItem_2, startParameter=code_block_31.par)
startPoint_4 = Curve.StartPoint(curve=trimByStartParameter)
byCenterPointRadiusAngle = Arc.ByCenterPointRadiusAngle(center=startPoint_4, radius=code_block_31.r, startAngle=code_block_31.angle1, endAngle=code_block_31.angle2)
code_block_32 = CodeBlock { true; false; }
startCurve_2 = Custom[StartCurve](perimeter=dictToVar_4.perimeter, reverse=dictToVar_4.reversed, numberOfSolids=dictToVar_4.numberOfSolids, nozzleD=dictToVar_4.nozzleD)
startPoint_5 = Curve.StartPoint(curve=trimByParameter_3@L1)
parameterAtPoint_2 = Curve.ParameterAtPoint(curve=startCurve_2, point=startPoint_5)
trimByEndParameter_2 = Curve.TrimByEndParameter(curve=startCurve_2, endParameter=parameterAtPoint_2)
endPoint_4 = Curve.EndPoint(curve=transpose_8@L2)
startPoint_6 = Curve.StartPoint(curve=create_perimeter_offset_and_2.out10@L2)
byStartPointEndPoint_7 = Line.ByStartPointEndPoint(startPoint=endPoint_4@L1, endPoint=startPoint_6@L1)
code_block_33 = CodeBlock(geo=create_perimeter_offset_and_2.out6, nozzleD=dictToVar_4.nozzleD)  # same code as code_block_8
endPoint_5 = Curve.EndPoint(curve=code_block_33.out2)
byStartPointEndPoint_8 = Line.ByStartPointEndPoint(startPoint=endPoint_5, endPoint=createAccess_2.accessPoint)

count_2 = List.Count(list=closestPointTo_2@L2)
code_block_34 = CodeBlock(x=count_2) { x-1; }
takeItems_2 = List.TakeItems(list=closestPointTo_2@L2, amount=code_block_34@L1)
restOfItems_3 = List.RestOfItems(list=closestPointTo_2@L2)
distanceTo_2 = Geometry.DistanceTo(geometry=takeItems_2@L2, other=restOfItems_3@L2)

# group (continued): inner Zick Zack ... DEBUG
code_block_35 = CodeBlock(dist=distanceTo_2, nozzleD=dictToVar_4.nozzleD, c=takeEveryNthItem)
# ---------- code_block_35.designscript (8 lines) ----------
fdist = List.Flatten(dist);
r = Math.Round(List.FirstItem(fdist),4) - nozzleD/2;
l = Curve.Length(c);
par = (l-r)/l;
vec1 = Line.Direction(c);
vec2 = Vector.YAxis();
angle1 = Vector.AngleWithVector(vec1,vec2) - 180;
angle2 = angle1 + 180;
# ----------------------------------------
trimByEndParameter_3 = Curve.TrimByEndParameter(curve=takeEveryNthItem, endParameter=code_block_35.par)
endPoint_6 = Curve.EndPoint(curve=trimByEndParameter_3)
byCenterPointRadiusAngle_2 = Arc.ByCenterPointRadiusAngle(center=endPoint_6, radius=code_block_35.r, startAngle=code_block_35.angle2, endAngle=code_block_35.angle1)
firstItem_2 = List.FirstItem(list=byCenterPointRadiusAngle_2@L2)
restOfItems_4 = List.RestOfItems(list=byCenterPointRadiusAngle_2@L2)
byBlendBetweenCurves = Curve.ByBlendBetweenCurves(curve1=byCenterPointRadiusAngle, curve2=restOfItems_4, endOrStart1=code_block_32.out1)
byBlendBetweenCurves_2 = Curve.ByBlendBetweenCurves(curve1=byCenterPointRadiusAngle_2, curve2=byCenterPointRadiusAngle, endOrStart2=code_block_32.out0)
join_2 = Curve.Join(curve=byBlendBetweenCurves_2@@L1, curves=byCenterPointRadiusAngle@L1)
join_3 = Curve.Join(curve=byBlendBetweenCurves@@L1, curves=join_2@L1)
join_4 = Curve.Join(curve=restOfItems_4@@L1, curves=join_3@L1)
join_5 = Curve.Join(curve=firstItem_2@L1, curves=join_4@L2)
byBlendBetweenCurves_3 = Curve.ByBlendBetweenCurves(curve1=firstItem_2, curve2=trimByEndParameter_2, endOrStart1=code_block_32.out1, endOrStart2=code_block_32.out0)
join_6 = Curve.Join(curve=join_5@L1, curves=byBlendBetweenCurves_3@L1)
lastItem_2 = List.LastItem(list=byCenterPointRadiusAngle_2@L2)
byBlendBetweenCurves_4 = Curve.ByBlendBetweenCurves(curve1=lastItem_2@L1, curve2=byStartPointEndPoint_7@L1)
join_7 = Curve.Join(curve=join_6@L1, curves=byBlendBetweenCurves_4@L1)
code_block_36 = CodeBlock(zickZack=join_7, middleCurve=create_perimeter_offset_and_2.out10, zToMid=byStartPointEndPoint_7, firstPart=trimByEndParameter_2, sideBack=removeSides.innerBorder, last=code_block_33.out2, connect=byStartPointEndPoint_8)
# ---------- code_block_36.designscript (5 lines) ----------
p1 = Autodesk.DesignScript.Geometry.Curve.EndPoint(zickZack);
p2 = Autodesk.DesignScript.Geometry.Curve.StartPoint(middleCurve);
zToMid;
l = [firstPart,zickZack,zToMid,middleCurve,sideBack,last,connect];
PolyCurve.ByJoinedCurves(List.Transpose(l),0.01);
# ----------------------------------------
connect_inner_to_outer_path = CodeBlock(accCurve=createAccess_2.accessCurve, innerPer=code_block_36.out4, outerPath=dictToVar_4.path, accIdx=dictToVar_4.accIdx)
# ---------- connect_inner_to_outer_path.designscript (5 lines) ----------
innerPerAcc = List.ReplaceItemAtIndex(accCurve@L2<1>,1,innerPer@L1<1>);
innerPoly = PolyCurve.ByJoinedCurves(innerPerAcc@L2<1>,0.01);
outerPathEx = Geometry.Explode(outerPath);
totalPath = List.ReplaceItemAtIndex(outerPathEx@L2<1>,accIdx,innerPoly@L1<1>);
Autodesk.DesignScript.Geometry.Curve.Join(List.FirstItem(totalPath@L2<1>),List.RestOfItems(totalPath@L2<1>));
# ----------------------------------------

varToDict_2 = Custom[VarToDict](perimeter=code_block_26.out0, path=connect_inner_to_outer_path.out4, accIdx=code_block_26.out1, reversed=create_perimeter_offset_and_2.out2, numberOfSolids=dictToVar_4.numberOfSolids, counter=code_block_26.out1, nozzleD=dictToVar_4.nozzleD)

# group: unsymmetric test
division_position = DoubleSlider(0.02, range=-0.15..0.15 step 0.001)
splitInnerSurface = Custom[SplitInnerSurface](dict=multiPerimeterPath, division=division_position, centerSurface=centerSurface.centerSurface)

final_curve_volume = CodeBlock(inputCurves=dictToVar_3.path, layerHeight=layer_thickness_m, nozzleWidth=nozzle_size_m)
# ---------- final_curve_volume.designscript (6 lines) ----------
allCurvesLength = Curve.Length(inputCurves);
totalPrintingCurveLength = Math.Sum(allCurvesLength);
layerHeight;
nozzleWidth;

materialVolume = totalPrintingCurveLength*layerHeight*nozzleWidth;
# ----------------------------------------
initial_wall_volume = CodeBlock(input=watch)
# ---------- initial_wall_volume.designscript (3 lines) ----------
wallSolids = Element.Geometry(input);
solidsVolume = Solid.Volume(wallSolids);
totalVolume = Math.Sum(List.Flatten(solidsVolume,-1));
# ----------------------------------------
code_block_37 = CodeBlock(curveVolume=final_curve_volume.materialVolume, wallVolume=initial_wall_volume.totalVolume) { curveVolume; wallVolume; percentageReduction = (curveVolume/wallVolume)*100; }
code_block_38 = CodeBlock(x=code_block_37.curveVolume) { x; }
code_block_39 = CodeBlock(x=final_curve_volume.allCurvesLength) { x; }

# group: Vertical ZigZag distance
flatten_3 = List.Flatten(list=pointsAtEqualSegmentLength)
firstItem_3 = List.FirstItem(list=flatten_3@L2)
flatten_4 = List.Flatten(list=closestPointTo)
firstItem_4 = List.FirstItem(list=flatten_4@L2)
distanceTo_3 = Geometry.DistanceTo(geometry=firstItem_3, other=firstItem_4)

firstItem_5 = List.FirstItem(list=distanceTo_3)
internal_triangle_volume_and = CodeBlock(base=code_block_15.out2, height=firstItem_5)  # "Internal triangle volume and inscribed circle diameter"
# ---------- internal_triangle_volume_and.designscript (5 lines) ----------
triangleArea=1/2*(2*base)*height;

hypotenuse = Math.Sqrt(base*base+height*height);
inscribedCircleRadius = (2*base)/2*Math.Sqrt((2*hypotenuse-2*base)/(2*hypotenuse+2*base));
inscribedCircleArea = inscribedCircleRadius*inscribedCircleRadius*Math.PI;
# ----------------------------------------

# group: First UI output
code_block_40 = CodeBlock { "Evaluation results"; }
code_block_41 = CodeBlock { "Proceed to LCA"; "Do not calculate LCA"; }
code_block_42 = CodeBlock { "Element width [m]: "; }
code_block_43 = CodeBlock { 3; 0; 1; 2; }
round = Math.Round(number=watch_3, digits=code_block_43.out0)
string_from_object = FromObject(object=round)
textnote_data = Custom[TextNote Data](Title=code_block_42, TextNote=string_from_object)  # package Data-Shapes; Create Data for TextNote input in UI.MultipleInputForm ++ . Check out www.data-shapes.net for more informations
code_block_44 = CodeBlock { "Zigzag angle [°]: "; }
round_2 = Math.Round(number=zigzag_angle, digits=code_block_43.out1)
string_from_object_2 = FromObject(object=round_2)
textnote_data_2 = Custom[TextNote Data](Title=code_block_44, TextNote=string_from_object_2)
code_block_45 = CodeBlock { "Zigzag displacement [zigzag step]: "; }
round_3 = Math.Round(number=displacement_step, digits=code_block_43.out2)
string_from_object_3 = FromObject(object=round_3)
textnote_data_3 = Custom[TextNote Data](Title=code_block_45, TextNote=string_from_object_3)
code_block_46 = CodeBlock { "AM design volume compared to original design [%]: "; }
round_4 = Math.Round(number=code_block_37.percentageReduction, digits=code_block_43.out2)
string_from_object_4 = FromObject(object=round_4)
textnote_data_4 = Custom[TextNote Data](Title=code_block_46, TextNote=string_from_object_4)
code_block_47 = CodeBlock { "Area(s) available per triangle per solid [m^2]"; }
round_5 = Math.Round(number=internal_triangle_volume_and.triangleArea, digits=code_block_43.out0)
string_from_object_5 = FromObject(object=round_5)
python_script = Python(IN[0]=string_from_object_5)  # IronPython2
# ---------- python_script.python (6 lines) ----------
data = IN[0]
str = ""
for x in data:
	str+= x + "\n"
	
OUT = str
# ----------------------------------------
textnote_data_5 = Custom[TextNote Data](Title=code_block_47, TextNote=python_script)
code_block_48 = CodeBlock { "Max diameter(s) of inscribed pipe per solid [m]"; }
inscribed_circle_radius_without = CodeBlock(x=internal_triangle_volume_and.inscribedCircleRadius) { x; }  # "Inscribed circle radius without thickness"
code_block_49 = CodeBlock(x=inscribed_circle_radius_without) { y=2*x; }
round_6 = Math.Round(number=code_block_49, digits=code_block_43.out0)
string_from_object_6 = FromObject(object=round_6)
python_script_2 = Python(IN[0]=string_from_object_6)  # IronPython2; same code as python_script
textnote_data_6 = Custom[TextNote Data](Title=code_block_48, TextNote=python_script_2)
code_block_50 = CodeBlock { "Area(s) of max inscribed pipe per solid [m^2]"; }
round_7 = Math.Round(number=internal_triangle_volume_and.inscribedCircleArea, digits=code_block_43.out0)
string_from_object_7 = FromObject(object=round_7)
python_script_3 = Python(IN[0]=string_from_object_7)  # IronPython2; same code as python_script
textnote_data_7 = Custom[TextNote Data](Title=code_block_50, TextNote=python_script_3)
code_block_51 = CodeBlock { "AM design total material volume [m^3]: "; }
string_from_object_8 = FromObject(object=code_block_37.curveVolume)
textnote_data_8 = Custom[TextNote Data](Title=code_block_51, TextNote=string_from_object_8)
code_block_52 = CodeBlock { "Total AM design curve length [m]: "; }
string_from_object_9 = FromObject(object=final_curve_volume.totalPrintingCurveLength)
textnote_data_9 = Custom[TextNote Data](Title=code_block_52, TextNote=string_from_object_9)
list_create = List.Create(item0=textnote_data, item1=textnote_data_2, item2=textnote_data_3, item3=textnote_data_4, item4=textnote_data_5, item5=textnote_data_6, item6=textnote_data_7, item7=textnote_data_8, item8=textnote_data_9)
boolean = BoolSelector(true)
passthrough = Custom[Passthrough](passThrough=boolean, waitFor=code_block_37.percentageReduction)  # package Clockwork for Dynamo 2.x; Forces a sequential order of execution. The node wired into the output of the Passthrough node will be executed *after* the node wired into the waitFor input (e.g. important for some Revit operations). The value of the passThrough input will be passed on to the node wired into the output port of the Passthrough node.

not_ = Not(x=pick_evaluate_adjust.Error)
and_ = And(bool0=not_, bool1=passthrough)

# group (continued): First UI output
multipleinputform = Custom[MultipleInputForm ++](Description_optional=code_block_40, ButtonText_optional=code_block_41.out0, Inputs=list_create, Toggle=and_, CancelButtonText_optional=code_block_41.out1)  # package Data-Shapes; Create a form with multiple inputs. see www.data-shapes.net for tutorials and infos!

# group: LCA input
code_block_53 = CodeBlock { "LCA calculation input [A1-A3]"; }
code_block_54 = CodeBlock { "Calculate inital LCA"; "Abort"; }
code_block_55 = CodeBlock { "Use mix percentage vs content per m^3"; "Tick for mix percentage"; }
boolean_input = Custom[Boolean input](InputName=code_block_55.out0, SideText=code_block_55.out1)  # package Data-Shapes; Creates a boolean input for UI.MultipleInputForm ++ . Check out www.data-shapes.net for more infos!
code_block_56 = CodeBlock()
# ---------- code_block_56.designscript (23 lines) ----------
"Proposal cement content in mix percentage [%]";
"23.69";
true;

"Proposal cement density [kg/m^3]";
"3200";
true;

"Or Proposal cement content per m^3 [kg/m^3]";
"750";
true;

"Cement GHG per kg [kg CO2 eq.]";
"0.782";
true;

"Original structural layer cement content per m^3 [kg/m^3]";
"480";
true;

"Original structural layer GHG per kg [kg CO2 eq.] for comparison";
"0.782";
true;
# ----------------------------------------
textbox_data = Custom[TextBox Data](InputName=code_block_56.out0, DefaultText=code_block_56.out1, IsNumberEntry=code_block_56.out2)  # package Data-Shapes; Create Data for TextBox input in UI.MultipleInputForm ++ . Check out www.data-shapes.net for more informations
textbox_data_2 = Custom[TextBox Data](InputName=code_block_56.out3, DefaultText=code_block_56.out4, IsNumberEntry=code_block_56.out5)
textbox_data_3 = Custom[TextBox Data](InputName=code_block_56.out6, DefaultText=code_block_56.out7, IsNumberEntry=code_block_56.out8)
textbox_data_4 = Custom[TextBox Data](InputName=code_block_56.out9, DefaultText=code_block_56.out10, IsNumberEntry=code_block_56.out11)
textbox_data_5 = Custom[TextBox Data](InputName=code_block_56.out12, DefaultText=code_block_56.out13, IsNumberEntry=code_block_56.out14)
textbox_data_6 = Custom[TextBox Data](InputName=code_block_56.out15, DefaultText=code_block_56.out16, IsNumberEntry=code_block_56.out17)
list_create_2 = List.Create(item0=boolean_input, item1=textbox_data, item2=textbox_data_2, item3=textbox_data_3, item4=textbox_data_4, item5=textbox_data_5, item6=textbox_data_6)
not_2 = Not(x=multipleinputform.Was_Cancelled)
and_2 = And(bool0=multipleinputform.Was_Run, bool1=not_2)
code_block_57 = CodeBlock { 600; 400; }
multipleinputform_2 = Custom[MultipleInputForm ++](Description_optional=code_block_53, ButtonText_optional=code_block_54.out0, Inputs=list_create_2, Toggle=and_2, CancelButtonText_optional=code_block_54.out1, Width_optional=code_block_57.out0, LabelWidth_optional=code_block_57.out1)

# group: Initial LCA calculation
code_block_58 = CodeBlock(lcaInput=multipleinputform_2.User_Inputs, curveVolume=code_block_37.curveVolume, wallVolumeTotal=code_block_37.wallVolume, structureVolumeShare=code_block_3.structureVolumeShare)
# ---------- code_block_58.designscript (23 lines) ----------
lcaInput;
curveVolume;
wallVolumeTotal;
structureVolumeShare;

structureVolume = wallVolumeTotal*structureVolumeShare;
proposalCementGHG = [Imperative]{
if (lcaInput[0] == true)
	{
		// Mix percentage case
		proposalTotalGHG = (lcaInput[1]/100)*lcaInput[2]*curveVolume*lcaInput[4];
		return proposalTotalGHG;
	}
	else
	{
		// Content per m^3 case
		proposalTotalGHG = lcaInput[3]*curveVolume*lcaInput[4];
		return proposalTotalGHG;
	}
};

originalCementGHG = structureVolume*lcaInput[5]*lcaInput[6];
compareGHG = proposalCementGHG/originalCementGHG;
# ----------------------------------------
code_block_59 = CodeBlock { "Initial LCA output [A1-A3]"; }
code_block_60 = CodeBlock { "Proceed to detailed element LCA with prefixed values"; "Do not calculate detailed LCA"; 600; }
code_block_61 = CodeBlock { "Proposal design cement GHG [kg CO2 eq.]: "; }
code_block_62 = CodeBlock(x=code_block_58.out5) { x; }
string_from_object_10 = FromObject(object=code_block_62)
textnote_data_10 = Custom[TextNote Data](Title=code_block_61, TextNote=string_from_object_10)
code_block_63 = CodeBlock { "Original design cement GHG [kg CO2 eq.]: "; }
code_block_64 = CodeBlock(x=code_block_58.out6) { x; }
string_from_object_11 = FromObject(object=code_block_64)
textnote_data_11 = Custom[TextNote Data](Title=code_block_63, TextNote=string_from_object_11)
code_block_65 = CodeBlock { "AM design GHG compared to original design [%]: "; }
code_block_66 = CodeBlock(x=code_block_58.out7) { x; }
string_from_object_12 = FromObject(object=code_block_66)
textnote_data_12 = Custom[TextNote Data](Title=code_block_65, TextNote=string_from_object_12)
list_create_3 = List.Create(item0=textnote_data_10, item1=textnote_data_11, item2=textnote_data_12)
not_3 = Not(x=multipleinputform_2.Was_Cancelled)
and_3 = And(bool0=multipleinputform_2.Was_Run, bool1=not_3)
multipleinputform_3 = Custom[MultipleInputForm ++](Description_optional=code_block_59, ButtonText_optional=code_block_60.out0, Inputs=list_create_3, Toggle=and_3, CancelButtonText_optional=code_block_60.out1, Width_optional=code_block_60.out2)

# group: Total AM design GHG output
code_block_67 = CodeBlock { "Total LCA for AM proposal [A1-A3]"; }
code_block_68 = CodeBlock { "Finish"; }
code_block_69 = CodeBlock()
# ---------- code_block_69.designscript (6 lines) ----------
"Proposal mix constituents [%]: ";
"Cement CEM I 52.5N - 23.69 % \n Silica Fumes - 21.05 % \n Sibelco CV32 Sand - 45.31 % \n Water - 9.30 % \n Admixtures - 0.65 %";

"GHG per material [kg CO2 eq.]:";

"Total GHG emissions [kg CO2 eq.]:";
# ----------------------------------------
textnote_data_13 = Custom[TextNote Data](Title=code_block_69.out0, TextNote=code_block_69.out1)
code_block_70 = CodeBlock(curveVolume=code_block_58.out1)
# ---------- code_block_70.designscript (10 lines) ----------
curveVolume;

totalLCA = [];

totalLCA[0] = 0.2369*3200*0.782*curveVolume;
totalLCA[1] = 0.2105*2200*0.5797*curveVolume;
totalLCA[2] = 0.4531*2650*0.03326*curveVolume;
totalLCA[3] = 0.0930*997*0.000128*curveVolume;

totalLCASum = Math.Sum(totalLCA);
# ----------------------------------------
code_block_71 = CodeBlock(x=code_block_70.totalLCA) { x; }
string_from_object_13 = FromObject(object=code_block_71)
python_script_4 = Python(IN[0]=string_from_object_13)  # IronPython2; same code as python_script
textnote_data_14 = Custom[TextNote Data](Title=code_block_69.out2, TextNote=python_script_4)
not_4 = Not(x=multipleinputform_3.Was_Cancelled)
and_4 = And(bool0=multipleinputform_3.Was_Run, bool1=not_4)

string_from_object_14 = FromObject(object=code_block_70.totalLCASum)
textnote_data_15 = Custom[TextNote Data](Title=code_block_69.out3, TextNote=string_from_object_14)

# group (continued): Total AM design GHG output
list_create_4 = List.Create(item0=textnote_data_13, item1=textnote_data_14, item2=textnote_data_15)
multipleinputform_4 = Custom[MultipleInputForm ++](Description_optional=code_block_67, ButtonText_optional=code_block_68, Inputs=list_create_4, Toggle=and_4)

code_block_72 = CodeBlock(x=create_insert_and_connect_inner.out0) { x; }
code_block_73 = CodeBlock(x=code_block_17.out7) { x; }
code_block_74 = CodeBlock(x=code_block_17.out8) { x; }
code_block_75 = CodeBlock(x=code_block_17.out9) { x; }
code_block_76 = CodeBlock(x=create_insert_and_connect_inner.out1) { x; }
code_block_77 = CodeBlock(x=code_block_76) { x[0][3]; }  # frozen
code_block_78 = CodeBlock { 0.5; 0.55; 0.45; }
code_block_79 = CodeBlock(t1=code_block_77, num1=code_block_78.out0) { point1 = Curve.PointAtChordLength(t1, num1, num1, true); }
pointAtParameter = Curve.PointAtParameter(curve=code_block_77, param=code_block_78.out1)
code_block_80 = CodeBlock(t1=code_block_77, num1=code_block_78.out2) { point1 = Curve.PointAtParameter(t1, num1); }
list_create_5 = List.Create(item0=pointAtParameter, item1=code_block_80)
code_block_81 = CodeBlock(t1=code_block_77, t2=list_create_5) { curve1 = Curve.SplitByPoints(t1, t2); }
code_block_82 = CodeBlock { 1; }  # frozen
pointAtParameter_2 = Curve.PointAtParameter(curve=code_block_77, param=code_block_78.out0)
byCenterPointStartPointEndPoint = Arc.ByCenterPointStartPointEndPoint(centerPoint=pointAtParameter_2, startPoint=pointAtParameter, endPoint=code_block_80)
code_block_83 = CodeBlock(curve1=code_block_81, num1=code_block_82, arc1=byCenterPointStartPointEndPoint) { t1 = List.ReplaceItemAtIndex(curve1, num1, arc1); }
code_block_84 = CodeBlock(t1=code_block_83) { polyCurve1 = PolyCurve.ByJoinedCurves(t1, 0.001); }
code_block_85 = CodeBlock(x=create_insert_and_connect_inner.out24) { x; }
code_block_86 = CodeBlock()  # frozen; unwired: x
# ---------- code_block_86.designscript (26 lines) ----------
x;
/*
// 1st bug explanation https://github.com/DynamoDS/Dynamo/issues/6620

polyInsertOuter = [Imperative]{
	//if (true == true)
	//{
		z = [];
		z[0] = x[0][2].PointAtChordLength(0.5,0.5,true);
		/*for (i in 0..countInside-1)
			{
				originalCurve = inputPath[i][2+insertSolid];
				/*pointFront = Curve.PointAtChordLength(originalCurve, distanceBetweenZigzags[insertSolid], insertCenter, true);
				pointBack = Curve.PointAtChordLength(originalCurve, distanceBetweenZigzags[insertSolid], insertCenter, false);
				pointCenter = Curve.PointAtParameter(originalCurve, insertCenter);
				arc = Arc.ByCenterPointStartPointEndPoint(pointCenter, pointFront, PointBack);
				splitCurve = Curve.SplitByPoints(originalCurve, [pointFront, pointBack]);
				newCurve = PolyCurve.ByJoinedCurves(List.ReplaceItemAtIndex(splitCurve, 1, arc), 0.001);

			}


		return z;
	//}
};
*/;
# ----------------------------------------
code_block_87 = CodeBlock(x=create_insert_and_connect_inner.out27) { x; }
code_block_88 = CodeBlock(y=create_insert_and_connect_inner.out0) { x=List.Count(y); }
