# Dynamo custom node RegularCrossSection.dyf (Dynamo 2.3.0.5885)
# category: 3D-Print
# Creates a cross section of a 3D printing layer

# group: Input
geometry = Input(geometry: var[]..[])
curve_parameters = CodeBlock { 0; 1; }
nozzleSize = Input(nozzleSize: var[]..[])
layerThickness = Input(layerThickness: var[]..[])
size_parameters = CodeBlock(nozzleD=nozzleSize, layerH=layerThickness) { nozzleD/2-layerH/3; nozzleD/2; layerH/3; }
numberOfCurves = Input(numberOfCurves: var[]..[])

# group: Sweep center points and vectors
center_point_for_sweep = Curve.StartPoint(curve=geometry)
vector_for_sweep = Curve.NormalAtParameter(curve=geometry, param=curve_parameters.out0)
length_from_center_to_arc = Vector.Scale(vector=vector_for_sweep, scale_factor=size_parameters.out0)
half_width = Vector.Scale(vector=vector_for_sweep, scale_factor=size_parameters.out1)
ZAxis = Vector.ZAxis()
layer_height = Vector.Scale(vector=ZAxis, scale_factor=layerThickness)
lower_center_point = Point.Subtract(point=center_point_for_sweep, vectorToSubtract=layer_height)

# group: Sweep corner points
upper_point_before_arc = Point.Add(point=center_point_for_sweep, vectorToAdd=length_from_center_to_arc)
upper_help_point = Point.Add(point=center_point_for_sweep, vectorToAdd=half_width)
lower_help_point = Point.Add(point=lower_center_point, vectorToAdd=half_width)
lower_point_before_arc = Point.Subtract(point=upper_point_before_arc, vectorToSubtract=layer_height)

# group: Sweep lines and arcs
upper_horizontal_line = Line.ByStartPointEndPoint(startPoint=center_point_for_sweep, endPoint=upper_point_before_arc)
help_line_for_arc = Line.ByStartPointEndPoint(startPoint=upper_help_point, endPoint=lower_help_point)
upper_arc = Arc.ByFillet(curve1=upper_horizontal_line, curve2=help_line_for_arc, radius=size_parameters.out2)
endPoint = Curve.EndPoint(curve=upper_arc)
lower_horizontal_line = Line.ByStartPointEndPoint(startPoint=lower_point_before_arc, endPoint=lower_center_point)
lower_arc = Arc.ByFillet(curve1=help_line_for_arc, curve2=lower_horizontal_line, radius=size_parameters.out2)
startPoint = Curve.StartPoint(curve=lower_arc)
byStartPointEndPoint = Line.ByStartPointEndPoint(startPoint=endPoint, endPoint=startPoint)

# group: Finish sweep cross section
join = List.Join()  # unwired: list0, list1, list2, list3
combine = List.Combine(comb=join, list1=upper_arc, list2=byStartPointEndPoint, list3=lower_arc, list4=lower_horizontal_line)
join_2 = Curve.Join(curve=upper_horizontal_line, curves=combine)
mirror_normal = Vector.ByTwoPoints(start=center_point_for_sweep, end=upper_point_before_arc)
mirror_plane = Plane.ByOriginNormal(origin=center_point_for_sweep, normal=mirror_normal)
mirror = Geometry.Mirror(geometry=join_2, mirrorPlane=mirror_plane)
join_3 = Curve.Join(curve=join_2@L1, curves=mirror@L1)

# group: Rotation centerpoint and vectors
center_point_for_rotation = Curve.EndPoint(curve=geometry)
vector_for_rotation = Curve.NormalAtParameter(curve=geometry, param=curve_parameters.out1)
length_from_center_to_arc_2 = Vector.Scale(vector=vector_for_rotation, scale_factor=size_parameters.out0)
half_width_2 = Vector.Scale(vector=vector_for_rotation, scale_factor=size_parameters.out1)
ZAxis_2 = Vector.ZAxis()
layer_height_2 = Vector.Scale(vector=ZAxis_2, scale_factor=layerThickness)
lower_center_point_2 = Point.Subtract(point=center_point_for_rotation, vectorToSubtract=layer_height_2)

# group: Rotation corner points
upper_point_before_arc_2 = Point.Add(point=center_point_for_rotation, vectorToAdd=length_from_center_to_arc_2)
upper_help_point_2 = Point.Add(point=center_point_for_rotation, vectorToAdd=half_width_2)
lower_help_point_2 = Point.Add(point=lower_center_point_2, vectorToAdd=half_width_2)
lower_point_before_arc_2 = Point.Subtract(point=upper_point_before_arc_2, vectorToSubtract=layer_height_2)

# group: Rotation lines and arcs
upper_horizontal_line_2 = Line.ByStartPointEndPoint(startPoint=center_point_for_rotation, endPoint=upper_point_before_arc_2)
help_line_for_arc_2 = Line.ByStartPointEndPoint(startPoint=upper_help_point_2, endPoint=lower_help_point_2)
upper_arc_2 = Arc.ByFillet(curve1=upper_horizontal_line_2, curve2=help_line_for_arc_2, radius=size_parameters.out2)
endPoint_2 = Curve.EndPoint(curve=upper_arc_2)
lower_horizontal_line_2 = Line.ByStartPointEndPoint(startPoint=lower_point_before_arc_2, endPoint=lower_center_point_2)
lower_arc_2 = Arc.ByFillet(curve1=help_line_for_arc_2, curve2=lower_horizontal_line_2, radius=size_parameters.out2)
startPoint_2 = Curve.StartPoint(curve=lower_arc_2)
vertical_side = Line.ByStartPointEndPoint(startPoint=endPoint_2, endPoint=startPoint_2)

# group: Finish rotation cross section
join_4 = List.Join()  # unwired: list0, list1, list2, list3
combine_2 = List.Combine(comb=join_4, list1=upper_arc_2, list2=vertical_side, list3=lower_arc_2, list4=lower_horizontal_line_2)
join_5 = Curve.Join(curve=upper_horizontal_line_2, curves=combine_2)
code_block = CodeBlock(nol=numberOfCurves) { lastIdx = nol-1; }
removeItemAtIndex = List.RemoveItemAtIndex(list=join_5@L2, indices=code_block)

# group: Inter layer cross section
lastItem = List.LastItem(list=join_5@L2)
startPoint_3 = Curve.StartPoint(curve=lastItem)
upper_point_before_arc_last = List.LastItem(list=upper_point_before_arc_2@L2)
mirror_normal_2 = Vector.ByTwoPoints(start=startPoint_3, end=upper_point_before_arc_last)
mirror_plane_2 = Plane.ByOriginNormal(origin=startPoint_3, normal=mirror_normal_2)
mirror_2 = Geometry.Mirror(geometry=lastItem, mirrorPlane=mirror_plane_2)
join_6 = Curve.Join(curve=lastItem@L1, curves=mirror_2@L1)

# group: Output
crossSection = Output(join_3)
revolveCrossSection = Output(removeItemAtIndex)
InterlayerCrossSection = Output(join_6)
