# Dynamo custom node RemoveSides.dyf (Dynamo 2.3.0.5885)
# category: 3D-Print
# Removes the sides of a perimeter curve by bool mask.

geometry = Input(geometry: var[]..[])
numberOfSolids = Input(numberOfSolids: var[]..[])
code_block = CodeBlock(nos=numberOfSolids, geo=geometry) { 0..#nos..1; maxIdx=List.FirstItem(List.Count(geo@L2<1>))-1; maxIdx-1..#nos..-1; }
getItemAtIndex = List.GetItemAtIndex(list=geometry@L2, index=code_block.out0)
byJoinedCurves = PolyCurve.ByJoinedCurves(curves=getItemAtIndex)
outerBorder = Output(byJoinedCurves)
getItemAtIndex_2 = List.GetItemAtIndex(list=geometry@L2, index=code_block.out2)
byJoinedCurves_2 = PolyCurve.ByJoinedCurves(curves=getItemAtIndex_2)
innerBorder = Output(byJoinedCurves_2)
