# Dynamo custom node SingleOutputInnerPath.dyf (Dynamo 2.3.0.5885)
# category: 3D-Print.Utilities
# Same as InnerPerimeterPath

dict = Input(dict: var[]..[])
dictToVar = Custom[DictToVar](dict=dict)  # Extracts dictionary content
innerPerimeterPath = Custom[InnerPerimeterPath](outerPath=dictToVar.path, reversed=dictToVar.reversed, numberOfSolids=dictToVar.numberOfSolids, accessIndex=dictToVar.accIdx, outerPerimeter=dictToVar.perimeter, nozzleD=dictToVar.nozzleD)  # Creates inner path along the perimeter path
code_block = CodeBlock(x=dictToVar.counter) { x+1; }
varToDict = Custom[VarToDict](perimeter=innerPerimeterPath.perimeter, path=innerPerimeterPath.innerPerimeterPath, accIdx=innerPerimeterPath.accessIdx, reversed=innerPerimeterPath.reversed, numberOfSolids=dictToVar.numberOfSolids, counter=code_block, nozzleD=dictToVar.nozzleD)  # Creates dictionary from Variables
dict_2 = Output(varToDict)  # "dict"
