# Dynamo custom node SplitInnerSurface.dyf (Dynamo 2.6.1.8786)
# category: 3D-Print

dict = Input(dict: var[]..[])
centerSurface = Input(centerSurface: var[]..[])
division = Input(division: var[]..[])

# group: Split layers
dictToVar = Custom[DictToVar](dict=dict)  # Extracts dictionary content
byPatch = Surface.ByPatch(closedCurve=dictToVar.perimeter)
offset = Surface.Offset(surface=centerSurface, distance=division)
split = Geometry.Split(geometry=byPatch, other=offset)
perimeterCurves = Surface.PerimeterCurves(surface=split)
byJoinedCurves = PolyCurve.ByJoinedCurves(curves=perimeterCurves)

perimeters = Output(byJoinedCurves)
