# Dynamo custom node StartCurve.dyf (Dynamo 2.3.0.5885)
# category: 3D-Print
# Creates a offset curve that connects to the outer perimeter

perimeter = Input(perimeter: var[]..[])
reverse = Input(reverse: var[]..[])
numberOfSolids = Input(numberOfSolids: var[]..[])
nozzleD = Input(nozzleD: var[]..[])
start_curve = CodeBlock(perimeter=perimeter, reverse=reverse, nos=numberOfSolids, nozzleD=nozzleD)
# ---------- start_curve.designscript (26 lines) ----------
// Explode perimeter and reverse if outer perimeter is not reversed
exPer=Geometry.Explode(perimeter);
reverse;
nos;
expl=[Imperative]{
if (!reverse)
{
return exPer;
}
else
{
reverted=[];
for (i in 0..List.Count(exPer)-1)
{
reverted[i]=List.Reverse(exPer[i]);
reverted[i]=List.ShiftIndices(reverted[i],-nos+2);
}
return reverted;
}
};
// Create first curve
cRest=List.RemoveItemAtIndex(expl@L2<1>,1);
cJoined=PolyCurve.ByJoinedCurves(cRest,0.0001);
offCurve=Curve.Offset(cJoined,-nozzleD);
exOffCurve=Curve.Explode(offCurve);
firstExCurve=List.FirstItem(exOffCurve@L2<1>);
# ----------------------------------------
startCurve = Output(start_curve.out8)
