# Dynamo custom node Update_thicknesses.dyf (Dynamo 2.10.1.3976)
# category: Revit
# Updating thicknesses of selected elements
# packages: Genius Loci 2022.1.5, Data-Shapes 2022.2.103, Clockwork for Dynamo 2.x 2.3.0

dict = Input(dict: var[]..[])
watch = Watch(dict)
code_block = CodeBlock { "Type"; }
elementType = Element.ElementType(element=dict)
number = DoubleInput(0)
getItemAtIndex = List.GetItemAtIndex(list=elementType, index=number)
watch_2 = Watch(getItemAtIndex)
get_compoundstructurelayers = Custom[Get CompoundStructureLayers](ElementOrFamilyType=elementType)  # package Genius Loci; Retrieves the properties of the compound layers of wall, floor, roof or ceiling Type.

# group: Obtain original wall thicknesses
number_2 = DoubleInput(0)
getItemAtIndex_2 = List.GetItemAtIndex(list=get_compoundstructurelayers.Thickness, index=number_2)
watch_3 = Watch(getItemAtIndex_2)
number_3 = DoubleInput(0)
getItemAtIndex_3 = List.GetItemAtIndex(list=get_compoundstructurelayers.LayerFunction, index=number_3)
watch_4 = Watch(getItemAtIndex_3)
string_from_object = FromObject(object=watch_4)
code_block_2 = CodeBlock { "Structure"; }
contains = String.Contains(str=string_from_object, searchFor=code_block_2)
filterByBoolMask = List.FilterByBoolMask(list=watch_3, mask=contains)
watch_5 = Watch(filterByBoolMask.in)
sum_of_structural_thickness = Math.Sum(values=watch_5)
watch_6 = Watch(sum_of_structural_thickness)
total_wall_thickness = Math.Sum(values=watch_3)
watch_7 = Watch(total_wall_thickness)
watch_8 = Watch(filterByBoolMask.out)
sum_of_non_structural_thickness = Math.Sum(values=watch_8)
watch_9 = Watch(sum_of_non_structural_thickness)

# group: Evaluate inputs and call UI for user to decide
string = StringInput("Choose 3D printed wall thickness")
string_2 = StringInput("Confirm")
code_block_3 = CodeBlock { "Existing structural thickness: "; }
string_from_object_2 = FromObject(object=watch_6)
textnote_data = Custom[TextNote Data](Title=code_block_3, TextNote=string_from_object_2)  # package Data-Shapes; Create Data for TextNote input in UI.MultipleInputForm ++ . Check out www.data-shapes.net for more informations
code_block_4 = CodeBlock { "Total wall thickness: "; }
string_from_object_3 = FromObject(object=watch_7)
textnote_data_2 = Custom[TextNote Data](Title=code_block_4, TextNote=string_from_object_3)
code_block_5 = CodeBlock { "Enter prefered thickness: "; }
textbox_data = Custom[TextBox Data](InputName=code_block_5)  # package Data-Shapes; Create Data for TextBox input in UI.MultipleInputForm ++ . Check out www.data-shapes.net for more informations
list_create = List.Create(item0=textnote_data, item1=textnote_data_2, item2=textbox_data)
code_block_6 = CodeBlock(x=watch_7) { x>0; }
passthrough = Custom[Passthrough](passThrough=code_block_6, waitFor=list_create)  # package Clockwork for Dynamo 2.x; Forces a sequential order of execution. The node wired into the output of the Passthrough node will be executed *after* the node wired into the waitFor input (e.g. important for some Revit operations). The value of the passThrough input will be passed on to the node wired into the output port of the Passthrough node.
multipleinputform = Custom[MultipleInputForm ++](Description_optional=string, ButtonText_optional=string_2, Inputs=list_create, Toggle=passthrough)  # package Data-Shapes; Create a form with multiple inputs. see www.data-shapes.net for tutorials and infos!
watch_10 = Watch(multipleinputform.User_Inputs)
toNumber = String.ToNumber(str=watch_10)
code_block_7 = CodeBlock { 0; }
getItemAtIndex_4 = List.GetItemAtIndex(list=toNumber, index=code_block_7)

# group: Create new wall family type
code_block_8 = CodeBlock { "3D_Printing_Layer_Proposal"; }
code_block_9 = CodeBlock { "Concrete_for_3D_printing"; }
byName = Material.ByName(name=code_block_9)
create_compound_system = Custom[Create Compound System FamilyType](ElementOrFamilyType=watch_2, NewName=code_block_8, material=byName, Thickness=getItemAtIndex_4)  # package Genius Loci; Creates a new compound wall, floor, roof or ceiling Type and assigns material, width and function.

watch_11 = Watch(create_compound_system)
setParameterByName = Element.SetParameterByName(element=dict, parameterName=code_block, value=watch_11)
watch_12 = Watch(setParameterByName)
Elements = Output(watch_12)
Wall_Thickness = Output(getItemAtIndex_4)
