# Dynamo custom node VarToDict.dyf (Dynamo 2.3.0.5885)
# category: 3D-Print.Utilities
# Creates dictionary from Variables

perimeter = Input(perimeter: var[]..[])
path = Input(path: var[]..[])
accIdx = Input(accIdx: var[]..[])
reversed = Input(reversed: var[]..[])
numberOfSolids = Input(numberOfSolids: var[]..[])
counter = Input(counter: var[]..[])
nozzleD = Input(nozzleD: var[]..[])
code_block = CodeBlock(per=perimeter, path=path, idx=accIdx, rev=reversed, numberOfSolids=numberOfSolids, count=counter, nozzleD=nozzleD)
# ---------- code_block.designscript (7 lines) ----------
{"perimeter":per,
"path":path,
"accIdx":idx,
"reversed":rev,
"nos":numberOfSolids,
"counter":count,
"nozzleD":nozzleD};
# ----------------------------------------
dict = Output(code_block)
