# Dynamo custom node connectOffsetEnd.dyf (Dynamo 2.3.0.5885)
# category: 3D-Print.Utilities
# Connects two offsets at a preselected location.

# group: Inputs
perimeter = Input(perimeter: var[]..[])
index = Input(index: var[]..[] = 0)
nozzleD = Input(nozzleD: var[]..[])
layerH = Input(layerH: var[]..[])
offset = Input(offset: var[]..[])

getItemAtIndex = List.GetItemAtIndex(list=perimeter@L2, index=index)
code_block = CodeBlock(nozzleD=nozzleD, LayerH=layerH) { off=nozzleD+LayerH/3; }
length = Curve.Length(curve=getItemAtIndex)
code_block_2 = CodeBlock(off=code_block, L=length) { 1-off/L/2; }
trimByEndParameter = Curve.TrimByEndParameter(curve=getItemAtIndex, endParameter=code_block_2)
endPoint = Curve.EndPoint(curve=trimByEndParameter)
code_block_3 = CodeBlock { 1; }
tangentAtParameter = Curve.TangentAtParameter(curve=trimByEndParameter, param=code_block_3)
code_block_4 = CodeBlock { -1; }
scale = Vector.Scale(vector=tangentAtParameter, scale_factor=code_block_4)
ZAxis = Vector.ZAxis()
cross = Vector.Cross(vector=ZAxis, cross=tangentAtParameter)
scale_2 = Vector.Scale(vector=cross, scale_factor=code_block)
translate = Geometry.Translate(geometry=endPoint, direction=scale_2)
byStartEndAndTangencies = Arc.ByStartEndAndTangencies(point1=endPoint, vector1=scale, point2=translate, vector2=scale)
join = Curve.Join(curve=byStartEndAndTangencies@L1, curves=trimByEndParameter@L1)
getItemAtIndex_2 = List.GetItemAtIndex(list=offset@L2, index=index)
lastItem = List.LastItem(list=byStartEndAndTangencies@L2)
code_block_5 = CodeBlock { true; }
byBlendBetweenCurves = Curve.ByBlendBetweenCurves(curve1=getItemAtIndex_2, curve2=lastItem, endOrStart2=code_block_5)
join_2 = Curve.Join(curve=join@L1, curves=byBlendBetweenCurves@L1)
join_3 = Curve.Join(curve=join_2@L1, curves=getItemAtIndex_2@L1)

# group: Outputs
connection = Output(join_3)
